# Dynamo custom node ActiveDocument.FileSize.dyf (Dynamo 1.3.3.4111)
# category: Data-Shapes.Revit.Document
# Gets the file size of the ative document, even if it is a BIM360 Design workshared project.

python_script = Python()
# ---------- python_script.python (35 lines) ----------
#Copyright (c) Data Shapes - Mostafa El Ayoubi ,  2018
# @data_shapes ,  www.data-shapes.io , contact@data-shapes.io

import clr
clr.AddReference('RevitAPI')
from Autodesk.Revit.DB import *

clr.AddReference('RevitServices')
from RevitServices.Persistence import DocumentManager

import sys
pyt_path = r'C:\Program Files (x86)\IronPython 2.7\Lib'
sys.path.append(pyt_path)
import os
from os import listdir

import System
from System.IO import SearchOption
from System import Environment

doc = DocumentManager.Instance.CurrentDBDocument

pn = doc.PathName
try:
	guid = doc.WorksharingCentralGUID  
	AppDataList = Environment.GetFolderPath(Environment.SpecialFolder.ApplicationData).split("\\")
	AppDataList.pop(-1)
	AppData = "\\".join(AppDataList)
	location =  AppData + "\\Local\\Autodesk\\Revit"
	cashedFile = System.IO.Directory.GetFiles(location, str(guid) + ".rvt" ,SearchOption.AllDirectories)
	size = [os.path.getsize(file) for file in cashedFile][0]
except:
	size = os.path.getsize(pn)

OUT = str(size/1000000) + " mb"
# ----------------------------------------
FileSize = Output(python_script)
