# Dynamo custom node Add Shared Parameter(s) from txt.dyf (Dynamo 2.0.3.8810)
# category: Data-Shapes.Revit.SharedParameters
# Add shared parameters to project from SharedParameter .txt file

Categories = Input(Categories_: var[]..[])
Parameters = Input(Parameters_: var[]..[])
ParameterGroup = Input(ParameterGroup_: var[]..[])
IsInstanceParameter = Input(IsInstanceParameter: var[]..[])
python_script = Python(IN[0]=Categories, IN[1]=Parameters, IN[2]=ParameterGroup, IN[3]=IsInstanceParameter)
# ---------- python_script.python (67 lines) ----------
#Copyright (c) mostafa el ayoubi
#Data-Shapes www.data-shapes.net 2016 elayoub.mostafa@gmail.com


import clr
import System
clr.AddReference('RevitAPI')
from Autodesk.Revit.DB import*
clr.AddReference('RevitServices')
from RevitServices.Persistence import DocumentManager
from RevitServices.Transactions import TransactionManager
clr.AddReference('RevitAPIUI')
from Autodesk.Revit.UI import *
from Autodesk.Revit import Creation


doc = DocumentManager.Instance.CurrentDBDocument
uidoc = DocumentManager.Instance.CurrentUIDocument
app = doc.Application


if isinstance(IN[0], list):
	category = [i for i in IN[0]]
else:
	category= [IN[0]]
	
#getting list of categories
try:
	categories = [doc.Settings.Categories.get_Item(System.Enum.ToObject(BuiltInCategory, i.Id)) for i in category]
except:
	categories = [UnwrapElement(i) for i in category]
	
#creating category set
catset = app.Create.NewCategorySet()
[catset.Insert(j) for j in categories]

if isinstance(IN[1], list):
	parameters = [i for i in IN[1]]
else:
	parameters = [IN[1]]
	
try:
	group = [a for a in System.Enum.GetValues(BuiltInParameterGroup) if a == IN[2]][0]
except:
	group = [a for a in System.Enum.GetValues(BuiltInParameterGroup) if str(a) == IN[2]][0]
i = 0

TransactionManager.Instance.EnsureInTransaction(doc)

#Determining whether the parameters are type or instance
if IN[3]:
	bind = app.Create.NewInstanceBinding(catset)
else : 
	bind = app.Create.NewTypeBinding(catset)
#Adding the parameters to the project
bindmap = doc.ParameterBindings
for p in parameters:
	try:
		bindmap.Insert(p, bind, group)
		i += 1
	except:
		continue

TransactionManager.Instance.TransactionTaskDone()


OUT =  '%d shared parameters addes to project' %(i)
# ----------------------------------------
OUT = Output(python_script)
