# Dynamo custom node All Elements In View(s).dyf (Dynamo 2.13.1.3887)
# category: Data-Shapes.Revit.Elements
# Retrieves all visible element in a view or a set of views

Views = Input(Views_: var[])
python_script = Python(IN[0]=Views)  # IronPython2
# ---------- python_script.python (59 lines) ----------
#Copyright (c) mostafa el ayoubi ,	2023
#Data-Shapes www.data-shapes.net , mostafa.elayoubi@data-shapes.io

import clr
clr.AddReference('RevitAPI')
from Autodesk.Revit.DB import*
clr.AddReference('RevitServices')
from RevitServices.Persistence import DocumentManager
from RevitServices.Transactions import TransactionManager

doc = DocumentManager.Instance.CurrentDBDocument

if isinstance(IN[0],list):
	views = UnwrapElement(IN[0])
else:
	views = [UnwrapElement(IN[0])]
	
def elementsInScheduleView(doc,viewSchedule):
	#Listing items found by collector method
	initialList = FilteredElementCollector(doc, viewSchedule.Id).ToElementIds()
	#Getting info to be able to iterate through table rows
	table_data = viewSchedule.GetTableData()
	section_data = table_data.GetSectionData(SectionType.Body)	
	no_of_rows = section_data.NumberOfRows	
	itemInScheduleRowId = []
	ScheduleDef = viewSchedule.Definition
	itemized = 	ScheduleDef.IsItemized
	#iterating through rows...
	for i in range(no_of_rows):
		#we create subtransactions to temporary delete row and then rollback
		TransactionManager.Instance.EnsureInTransaction(doc)
		st = SubTransaction(doc)
		st.Start()		
		# Use Try/Except to handle any rows that can't be removed
		try:
			section_data.RemoveRow(i)
			#After deleting, we reuse the collector method to check the difference
			remaining = FilteredElementCollector(doc, viewSchedule.Id).ToElementIds()
			remaining = list(remaining)
			#deducing the element Id of the row by comparison
			#this logic here is to better handle the case of nested shared families, and host elements
			if itemized:
				deleted = [i for i in initialList if i not in  remaining][0]
				itemInScheduleRowId.append(deleted)  	
			else:
				deleted = [i for i in initialList if i not in  remaining]
				itemInScheduleRowId.extend(deleted)  			
			st.RollBack()			
		except:
			st.RollBack()			
		TransactionManager.Instance.ForceCloseTransaction()
	return [doc.GetElement(eid) for eid in itemInScheduleRowId]

OUT = []
for v in views:
	if v.ViewType == ViewType.Schedule:
		OUT.append(elementsInScheduleView(doc,v))
	else:
		OUT.append(FilteredElementCollector(doc,v.Id).ToElements())
# ----------------------------------------
Element_s = Output(python_script)  # "Element(s)"
