# Dynamo custom node All Elements Of Categories in View.dyf (Dynamo 2.3.0.5885)
# category: Data-Shapes.Revit.Elements
# Retrieves all elements of the given categories in the given view

Views = Input(Views_: var[]..[])
Categories = Input(Categories_: var[]..[])
python_script = Python(IN[0]=Views, IN[1]=Categories)
# ---------- python_script.python (38 lines) ----------
#Copyright (c) mostafa el ayoubi
#Data-Shapes www.data-shapes.net 2019 mostafa.elayoubi@data-shapes.io

import clr
clr.AddReference('RevitAPI')
from Autodesk.Revit.DB import*

clr.AddReference('ProtoGeometry')
from Autodesk.DesignScript.Geometry import *

clr.AddReference('RevitServices')
from RevitServices.Persistence import DocumentManager

import System
from System.Collections.Generic import*

doc = DocumentManager.Instance.CurrentDBDocument

def tolist(input):
	if isinstance(input,list):
		return input
	else:
		return [input]


view = UnwrapElement(IN[0])

categories = tolist(IN[1])
catfilters = []

for i in categories:
	catfilters.append(ElementCategoryFilter(System.Enum.ToObject(BuiltInCategory, int(str(i.Id)))))
catfilterlist = List[ElementFilter](catfilters)
filter = LogicalOrFilter(catfilterlist)

elems = FilteredElementCollector(doc,view.Id).WherePasses(filter).ToElements()

OUT = elems
# ----------------------------------------
Element_s = Output(python_script)  # "Element(s)"
