# Dynamo custom node Categories list.dyf (Dynamo 2.0.2.6826)
# category: Data-Shapes.Revit.Lists
# Gives list of all Revit categories and a matching list of their names

python_script = Python()  # graph input
# ---------- python_script.python (19 lines) ----------
#Copyright (c) mostafa el ayoubi
#Data-Shapes www.data-shapes.net 2016 elayoub.mostafa@gmail.com


import clr
clr.AddReference('RevitAPI')
from Autodesk.Revit.DB import*
clr.AddReference('RevitServices')
from RevitServices.Persistence import DocumentManager


doc = DocumentManager.Instance.CurrentDBDocument


cat = doc.Settings.Categories



OUT = cat , [x.Name for x in cat]
# ----------------------------------------
code_block = CodeBlock(x=python_script) { x[0]; x[1]; }
Revit_Categories = Output(code_block.out0)
Category_name_s = Output(code_block.out1)  # "Category name(s)"
