# Dynamo custom node ConditionalInput Data.dyf (Dynamo 2.5.0.7460)
# category: Data-Shapes.UI.Input
# Allows to create inputs that are enabled/disabled by a condition dor UI.MultipleInputForm++.

Options = Input(Options_: var[])
InputGroups_by_Option = Input(InputGroups_by_Option: var[][])
DefaultOptionIndex = Input(DefaultOptionIndex: int = 0)
python_script = Python(IN[0]=Options, IN[1]=InputGroups_by_Option, IN[2]=DefaultOptionIndex)
# ---------- python_script.python (24 lines) ----------
#Copyright (c) Data Shapes ,  2018
# @data_shapes ,  www.data-shapes.io , contact@data-shapes.io

class uiconditional():

    def __init__(self,inputname,_Conditions,_GroupedInputs,_defaultOptionIndex):
    	self.inputname = inputname
        self._Conditions = _Conditions
        self._GroupedInputs = _GroupedInputs
        self._defaultOptionIndex = _defaultOptionIndex

    def __repr__(self):
        return 'UI.Conditional input'
        
def toList(input):
	if isinstance(input,list):
		return input
	else:
		return [input]
        
x = uiconditional("",toList(IN[0]),toList(IN[1]),IN[2])


OUT = x
# ----------------------------------------
ConditionalInput_Data = Output(python_script)
