# Dynamo custom node DataTable input.dyf (Dynamo 2.0.2.6826)
# category: Data-Shapes.UI.Input
# Create a DataTable view input for UI.MultipleInputForm ++

InputName = Input(InputName: string = "Table Title")
Data = Input(Data: var[]..[])
FirstRowIsTitles = Input(FirstRowIsTitles: bool = false)
OpenExcelAtExport = Input(OpenExcelAtExport: bool = false)
ShowTitleAndFileInfoInExport = Input(ShowTitleAndFileInfoInExport: bool = true)
python_script = Python(IN[0]=InputName, IN[1]=Data, IN[2]=FirstRowIsTitles, IN[3]=OpenExcelAtExport, IN[4]=ShowTitleAndFileInfoInExport)
# ---------- python_script.python (42 lines) ----------
#Copyright (c) mostafa el ayoubi ,  2018
#Data-Shapes www.data-shapes.net , elayoubi.mostafa@gmail.com

import clr
clr.AddReference('RevitAPI')
from Autodesk.Revit.DB import*
clr.AddReference('RevitServices')
from RevitServices.Persistence import DocumentManager
from System import DateTime

dt = DateTime.Now

doc = DocumentManager.Instance.CurrentDBDocument

try:
	pname = doc.PathName
	try:
		name = pname.split('\\')[-1]

	except:
		name = pname.split("/")[-1] 		
except:
	name = "" 

class tableview():

    def __init__(self,inputname,_tabletitle,dataList,_hasTitle,_openExcel,_showinfo,_fileInfo):
    	self.inputname = inputname
        self._tabletitle = _tabletitle
        self.dataList = dataList
        self._hasTitle = _hasTitle
        self._openExcel = _openExcel
        self._showinfo = _showinfo
        self._fileInfo = _fileInfo

    def __repr__(self):
        return 'UI.DataTable input'
     
x = tableview("",IN[0],IN[1],IN[2],IN[3],IN[4],name + " , " + str(dt))


OUT =  x
# ----------------------------------------
TableView_input = Output(python_script)
