# Dynamo custom node Duplicate Element.dyf (Dynamo 2.0.2.6826)
# category: Data-Shapes.Revit.Elements
# Duplicates all types of elements including view templates

Elements = Input(Elements: var[]..[])
python_script = Python(IN[0]=Elements)
# ---------- python_script.python (35 lines) ----------
#Copyright (c) mostafa el ayoubi
#Node-mode 2016 elayoub.mostafa@gmail.com

import clr
clr.AddReference('RevitAPI')
from Autodesk.Revit.DB import *
import Autodesk

clr.AddReference('RevitServices')
import RevitServices
from RevitServices.Persistence import DocumentManager
from RevitServices.Transactions import TransactionManager

from System.Collections.Generic import*

doc = DocumentManager.Instance.CurrentDBDocument

if isinstance(IN[0],list):
	views = UnwrapElement(IN[0])
else:
	views = [UnwrapElement(IN[0])]

ids = [view.Id for view in views]

elementlist = List[ElementId](ids)

TransactionManager.Instance.EnsureInTransaction(doc)
for view in views:

	copyid = ElementTransformUtils.CopyElements(doc, elementlist, doc, Transform.Identity, CopyPasteOptions())
	newview = [doc.GetElement(id) for id in copyid]

TransactionManager.Instance.TransactionTaskDone()

OUT = newview
# ----------------------------------------
OUT = Output(python_script)
