# Dynamo custom node Element(s) cut.dyf (Dynamo 2.2.1.5175)
# category: Data-Shapes.Revit.Elements
# Cutting element(s) with element

ElementToBeCut = Input(ElementToBeCut: Revit.Elements.Element)
CuttingElements = Input(CuttingElements: Revit.Elements.Element)
python_script = Python(IN[0]=ElementToBeCut, IN[1]=CuttingElements)
# ---------- python_script.python (32 lines) ----------
#Copyright (c) mostafa el ayoubi
#Data-Shapes 2016 elayoub.mostafa@gmail.com

import clr
clr.AddReference('RevitAPI')
from Autodesk.Revit.DB import*
clr.AddReference('RevitServices')
from RevitServices.Persistence import DocumentManager
from RevitServices.Transactions import TransactionManager
from Autodesk.Revit.DB.SolidSolidCutUtils import AddCutBetweenSolids

doc = DocumentManager.Instance.CurrentDBDocument

if isinstance(IN[0],list):
	tobecut = [UnwrapElement(i) for i in IN[0]]
else:
	tobecut = [UnwrapElement(IN[0])]
cutting = UnwrapElement(IN[1])
count = []

TransactionManager.Instance.EnsureInTransaction(doc)

for t in tobecut:
	try:
		count.append(AddCutBetweenSolids(doc,t,cutting))
	except:
		pass

TransactionManager.Instance.TransactionTaskDone()


OUT = '%d elements coupés' % (len(count))
# ----------------------------------------
OUT = Output(python_script)
