# Dynamo custom node Excel.Worksheets.dyf (Dynamo 2.0.2.6826)
# category: Data-Shapes.Interop.Excel
# Gets worksheet names from specified Excel workbook.

FilePath = Input(FilePath: var[]..[])
python_script = Python(IN[0]=FilePath)
# ---------- python_script.python (22 lines) ----------
#Copyright (c) Data Shapes,  2018
#Data-Shapes www.data-shapes.net , elayoubi.mostafa@data-shapes.io @data_shapes

import clr
clr.AddReference('DynamoRevitDS')
import Dynamo
import sys
pyt_path = r'C:\Program Files (x86)\IronPython 2.7\Lib'
sys.path.append(pyt_path)
clr.AddReference('System')
from System import Guid
clr.AddReferenceByName('Microsoft.Office.Interop.Excel, Version=11.0.0.0, Culture=neutral, PublicKeyToken=71e9bce111e9429c')
from Microsoft.Office.Interop import Excel
ex = Excel.ApplicationClass()
ex.Visible = False
ex.DisplayAlerts = False
workbk = ex.Workbooks.Open(IN[0])
worksheets = workbk.Worksheets
wsnms = [w.Name for w in worksheets]
workbk.Close()
ex.Quit()
OUT = wsnms
# ----------------------------------------
Worksheet_Names = Output(python_script)
