# Dynamo custom node Export to FBX.dyf (Dynamo 2.2.1.5175)
# category: Data-Shapes.Export
# Exports 3D views to FBX format

ExportFolderPath = Input(ExportFolderPath: string)
prefix = Input(prefix_: string)
ThreeDView = Input(ThreeDView_: var[])
python_script = Python(IN[0]=ExportFolderPath, IN[1]=prefix, IN[2]=ThreeDView)
# ---------- python_script.python (35 lines) ----------
#Copyright (c) mostafa el ayoubi, 2016 elayoub.mostafa@gmail.com
#Data-Shapes www.data-shapes.net

import clr
clr.AddReference('RevitAPI')
from Autodesk.Revit.DB import*
clr.AddReference('RevitServices')
from RevitServices.Persistence import DocumentManager
from RevitServices.Transactions import TransactionManager

doc = DocumentManager.Instance.CurrentDBDocument

t = Transaction(doc,'export')
t.Start()

def tolist(input):
	if isinstance(input,list):
		return input
	else:
		return [input]

folder = IN[0]
prefix = IN[1]
views = tolist(IN[2])
result = []
vset = ViewSet()


for v in views:

    vset.Insert(UnwrapElement(v))
    result.append(doc.Export(folder,UnwrapElement(v).Name,vset,FBXExportOptions()))

t.Commit()
OUT = 'Success' 
# ----------------------------------------
OUT = Output(python_script)
