# Dynamo custom node Geometry.PruneDuplicates.dyf (Dynamo 2.0.2.6826)
# category: Data-Shapes.Geometry
# Removes all duplicate geometries from list.

GeometryList = Input(GeometryList: var[]..[])
python_script = Python(IN[0]=GeometryList)
# ---------- python_script.python (50 lines) ----------
#Copyright (c) Data Shapes ,  2018
#@data_shapes ,  www.data-shapes.io , contact@data-shapes.io

import clr
clr.AddReference('ProtoGeometry')
from Autodesk.DesignScript.Geometry import *


unique = []
uniqueStr = []

def toList(input):
	if isinstance(input,list):
		return input
	else:
		return [input]

def surfsol_ToSortedVertices(surfsol):
	return  ",".join(sorted([i.ToString() for i in surfsol.Vertices]))
	
def curve_ToSortedVertices(cv):
	nbs = cv.ToNurbsCurve()
	return ",".join(sorted([p.ToString() for p in nbs.ControlPoints()]))
	
def pt_ToSortedVertices(pt):
	return pt.ToString()


g = toList(IN[0])

for geom in g:
	try:
		#solids and surfaces
		if not (surfsol_ToSortedVertices(geom) in uniqueStr) :
			uniqueStr.append(surfsol_ToSortedVertices(geom))
			unique.append(geom)
	except:
		try:
			#Curves and lines
			if not (curve_ToSortedVertices(geom) in uniqueStr) :
				uniqueStr.append(curve_ToSortedVertices(geom))
				unique.append(geom)	
		except:
			#Points
			if not (pt_ToSortedVertices(geom) in uniqueStr) :
				uniqueStr.append(pt_ToSortedVertices(geom))
				unique.append(geom)							
		
		
OUT = unique
# ----------------------------------------
UniqueItems = Output(python_script)
