# Dynamo custom node GetAllElementsFromLinks++.dyf (Dynamo 2.0.3.8810)
# category: Data-Shapes.Revit.Document
# Get all elements of category or type from given documents

Documents = Input(Documents_: var[]..[])
CategoryOrType = Input(CategoryOrType: var[]..[])
python_script = Python(IN[0]=Documents, IN[1]=CategoryOrType)
# ---------- python_script.python (59 lines) ----------
#Copyright(c) 2019, Data Shapes , written by Mostafa El Ayoubi mostafa.elayoubi@data-shapes.io @data_shapes
# @datashapes_io ,  http://data-shapes.io

# This node is based on Konrad Sobon's Get All Elements From Linked Model
# The main differences are list handling and working with categories and element types as well. 

import clr
clr.AddReference('ProtoGeometry')
from Autodesk.DesignScript.Geometry import *

# Import RevitAPI
clr.AddReference("RevitAPI")
import Autodesk
from Autodesk.Revit.DB import *

import System

import sys
pyt_path = r'C:\Program Files (x86)\IronPython 2.7\Lib'
sys.path.append(pyt_path)

import traceback
#The inputs to this node will be stored as a list in the IN variable.
dataEnteringNode = IN


def toList(input):
	if isinstance(input,list):
		return input
	else:
		return [input]
		
		
_linkDocs = toList(IN[0])
filterInfo = IN[1]

resultList = []

errorReport = None

try:
	for _linkDoc in _linkDocs:
		filter = ElementCategoryFilter(System.Enum.ToObject(BuiltInCategory, filterInfo.Id))
		result = FilteredElementCollector(_linkDoc).WherePasses(filter).WhereElementIsNotElementType().ToElements()
		resultList.append(result)
except:
	# if error accurs anywhere in the process catch it
	try:
		for _linkDoc in _linkDocs:
			result = FilteredElementCollector(_linkDoc).OfClass(filterInfo).ToElements()
			resultList.append(result)
	except:			
		errorReport = traceback.format_exc()

#Assign your output to the OUT variable
if errorReport == None:
	OUT = resultList
else:
	OUT = errorReport
# ----------------------------------------
Elements = Output(python_script)
