# Dynamo custom node GetLinkedElement.InHostViewAndCategory.dyf (Dynamo 2.3.0.5885)
# category: Data-Shapes.Revit.Elements
# Gets linked elements in host view, filtered by category.

views = Input(views: var[])
LinkDoc = Input(LinkDoc: var[]..[])
Categories = Input(Categories_: var[]..[])
Refresh = Input(Refresh: bool = true)
python_script = Python(IN[0]=views, IN[1]=LinkDoc, IN[2]=Categories, IN[3]=Refresh)
# ---------- python_script.python (80 lines) ----------
#Copyright (c) mostafa el ayoubi ,  2017
#Data-Shapes www.data-shapes.net , elayoubi.mostafa@gmail.com

import clr
clr.AddReference('RevitAPI')
from Autodesk.Revit.DB import*
clr.AddReference('RevitServices')
from RevitServices.Persistence import DocumentManager
doc = DocumentManager.Instance.CurrentDBDocument
import System
from System.Collections.Generic import *

clr.AddReference('ProtoGeometry')
from Autodesk.DesignScript.Geometry import*
doc = DocumentManager.Instance.CurrentDBDocument

#Inputs
if isinstance(IN[2],list):
	categories = IN[2]
else:
	categories = [UnwrapElement(IN[2])]
linkdoc = IN[1]
if isinstance(IN[0],list):
	views = UnwrapElement(IN[0])
else:
	views = [UnwrapElement(IN[0])]

collector = []

#getting project base point elevation
basepointfilter = ElementCategoryFilter(BuiltInCategory.OST_ProjectBasePoint)
basepoint = FilteredElementCollector(doc).WherePasses(basepointfilter).ToElements()
bpelevation = [b.ParametersMap.get_Item('Elev').AsDouble() for b in basepoint]

#Category filter
catfilter = []
for i in categories:
	catfilter.append(ElementCategoryFilter(System.Enum.ToObject(BuiltInCategory, int(str(i.Id)))))

catfilterlist = List[ElementFilter](catfilter)
filter = LogicalOrFilter(catfilterlist)

UIunit = Document.GetUnits(doc).GetFormatOptions(UnitType.UT_Length).DisplayUnits
level = []
for v in views:

	#creating a boundingbox for each view from it's crop box and view range
	bb = v.CropBox
	vr = v.GetViewRange()
	topclip = PlanViewPlane.TopClipPlane
	bottomclip = PlanViewPlane.BottomClipPlane
	cutclip = PlanViewPlane.CutPlane
	toplevel = (doc.GetElement(vr.GetLevelId(topclip)))
	topoffset = vr.GetOffset(topclip)
	cutlevel = (doc.GetElement(vr.GetLevelId(cutclip)))
	cutoffset = vr.GetOffset(cutclip)
	try:
		topZ = toplevel.Elevation + topoffset - bpelevation[0]
	except:
		topZ = cutlevel.Elevation + cutoffset - bpelevation[0]
	bottomlevel = (doc.GetElement(vr.GetLevelId(bottomclip)))
	bottomoffset = vr.GetOffset(bottomclip)
	try:
		bottomZ = bottomlevel.Elevation + bottomoffset - bpelevation[0]
	except :
		bottomZ = cutlevel.Elevation - bpelevation[0]
	min = bb.Min
	max = bb.Max
	newmin = XYZ(min.X,min.Y,bottomZ)
	newmax = XYZ(max.X,max.Y,topZ)
	ol = Outline(newmin,newmax)

	#combining boundingbox and category filters
	bbfilter = BoundingBoxIntersectsFilter(ol)
	andfilter = LogicalAndFilter(filter,bbfilter)

	#collecting elements
	collector.append(FilteredElementCollector(linkdoc).WherePasses(andfilter).ToElements())

OUT = collector
# ----------------------------------------
elements = Output(python_script)
