# Dynamo custom node Grid.SetVerticalExtents.dyf (Dynamo 2.0.2.6826)
# category: Data-Shapes.Revit.Grids
# Set the vertical extents of all project grids

GridsToAdjust = Input(GridsToAdjust: var = true)  # Will take all grids if no input
BottomExtent = Input(BottomExtent: var[]..[])
TopExtent = Input(TopExtent: var[]..[])
python_script = Python(IN[0]=GridsToAdjust, IN[1]=BottomExtent, IN[2]=TopExtent)
# ---------- python_script.python (32 lines) ----------
#Copyright (c) mostafa el ayoubi
#Node-mode www.data-shapes.net 2016 elayoub.mostafa@gmail.com

import clr
clr.AddReference('RevitAPI')
from Autodesk.Revit.DB import*
clr.AddReference('RevitServices')
from RevitServices.Persistence import DocumentManager
from RevitServices.Transactions import TransactionManager

doc = DocumentManager.Instance.CurrentDBDocument
UIunit = Document.GetUnits(doc).GetFormatOptions(UnitType.UT_Length).DisplayUnits

def convunit(x):
	return UnitUtils.ConvertToInternalUnits(x,UIunit)
def toList(input):
	if isinstance(input,list):
		return UnwrapElement(input)
	else:
		return [UnwrapElement(input)]

if IN[0] != True:
	grids = toList(IN[0])
else:
	grids = [UnwrapElement(i) for i in FilteredElementCollector(doc).OfClass(Grid)]

TransactionManager.Instance.EnsureInTransaction(doc)
for g in grids:
	g.SetVerticalExtents(convunit(IN[1]),convunit(IN[2]))
TransactionManager.Instance.TransactionTaskDone()

OUT = grids
# ----------------------------------------
OUT = Output(python_script)
