# Dynamo custom node Image Data.dyf (Dynamo 2.2.1.5175)
# category: Data-Shapes.UI.Input
# Places an image on UI.MultipleInutForm ++ .

ImageTitle = Input(ImageTitle: string = "")
Image = Input(Image_: var[]..[])
ShowBorder_optional = Input(ShowBorder_optional: bool = true)
python_script = Python(IN[0]=ImageTitle, IN[1]=Image, IN[2]=ShowBorder_optional)
# ---------- python_script.python (17 lines) ----------
#Copyright (c) mostafa el ayoubi ,  2017
#Data-Shapes www.data-shapes.net , elayoubi.mostafa@gmail.com

class uiimage():

    def __init__(self,inputname,image,showborder):
        self.inputname = inputname    
        self.image = image
        self.showborder = showborder

    def __repr__(self):
        return 'UI.Image input'
        
x = uiimage(IN[0],IN[1],IN[2])


OUT = x
# ----------------------------------------
Image_input = Output(python_script)
