# Dynamo custom node ImportInstance.IsLinked.dyf (Dynamo 2.3.0.5885)
# category: Data-Shapes.Revit.Elements
# Returns boolean info indicating wether an ImportInstance is linked or not (meaning it's imported).

ImportInstance = Input(ImportInstance_: var[]..[])
isLinked = Python(IN[0]=ImportInstance)
# ---------- isLinked.python (17 lines) ----------
#Copyright (c) Data Shapes - Mostafa El Ayoubi ,  2018
# @data_shapes ,  www.data-shapes.io , contact@data-shapes.io

import clr
clr.AddReference('RevitAPI')
from Autodesk.Revit.DB import *

def toList(input):
	if isinstance(input,list):
		return UnwrapElement(input)
	else:
		return [UnwrapElement(input)]
	
importInstances = toList(IN[0])


OUT = [importInstance.IsLinked for importInstance in importInstances]
# ----------------------------------------
bool = Output(isLinked)
