# Dynamo custom node InputGroup Data.dyf (Dynamo 2.2.1.5175)
# category: Data-Shapes.UI.Input
# Creates a group of inputs for UI.MultipleInputForm ++ . Check out www.data-shapes.net for more infos !

GroupTitle = Input(GroupTitle: string = "")
Inputs = Input(Inputs: var[])
python_script = Python(IN[0]=GroupTitle, IN[1]=Inputs)
# ---------- python_script.python (17 lines) ----------
#Copyright (c) mostafa el ayoubi ,  2017
#Data-Shapes www.data-shapes.net , elayoubi.mostafa@gmail.com

class uigroup():

    def __init__(self,inputname,groupname,inputgroup):
    	self.inputname = inputname
        self.groupname = groupname
        self.inputgroup = inputgroup

    def __repr__(self):
        return 'UI.InputGroup'
        
x = uigroup("",IN[0],IN[1])


OUT = x
# ----------------------------------------
Input_Group = Output(python_script)
