# Dynamo custom node ModificationTracker.AllChanges.dyf (Dynamo 2.2.1.5175)
# category: Data-Shapes.ModificationTracker
# Takes ExistingElements Data as input and outputs lists with all geometry/parameter values change combinations . Check out www.Data-Shapes.net for more informations .

ExistingElementsData = Input(ExistingElementsData: var[]..[])
python_script = Python(IN[0]=ExistingElementsData)
# ---------- python_script.python (98 lines) ----------
#Copyright (c) mostafa el ayoubi ,  2016
#Data-Shapes www.data-shapes.net , elayoubi.mostafa@gmail.com
#This node was inspired by Jeremy Tammik @Jeremytammik

import clr
clr.AddReference('RevitAPI')
from Autodesk.Revit.DB import *

if isinstance(IN[0][0],list):
	elementsA = UnwrapElement(IN[0][0])
	elementsB = UnwrapElement(IN[0][1])
else :
	elementsA = [UnwrapElement(IN[0][0])]
	elementsB = [UnwrapElement(IN[0][1])]

def flatten(container):
    for i in container:
        if isinstance(i, (list,tuple)):
            for j in flatten(i):
                yield j
        else:
            yield i

def tostring(x):
	return x.ToString()
def getgeomlist(x):
	return list(x.get_Geometry(Options()))


def getvertices(x):
	#getting geometryelements as list
	geomelems = getgeomlist(x)
	#getting nested instance geometry for all geometry instances
	while any('GeometryInstance' in g for g in map(tostring,geomelems)):
		for index,i in enumerate(geomelems):
			if 'GeometryInstance' in i.ToString():
				geomelems[index] = i.GetInstanceGeometry()
			else:
				continue
			geomelems = list(flatten(geomelems))[0]
	#getting all faces, keeping meshes
	faces = []
	for i in geomelems:
		if 'Solid' in i.ToString():
			faces.append(list(i.Faces))
		elif 'Mesh' in i.ToString():
			faces.append(i)
		else:
			continue
	faces = list(flatten(faces))
	#getting all meshes
	meshes = []
	for f in faces:
		if 'Mesh' in f.ToString():
			meshes.append(f)
		else:
			meshes.append(f.Triangulate())
	#getting all vertices
	vertexlist = []
	for m in meshes:
		vertexlist.append(list(m.Vertices))
	vertexlist = list(flatten(vertexlist))
	#creating sorted vertex string representation of object for comparison with other indice of element
	vertexstr = ', '.join(sorted(set(map(tostring,vertexlist))))
	return vertexstr

def parametersnapshot(x):
	parameters = x.Parameters
	paramnames = [p.Definition.Name for p in parameters]
	sortedindex = sorted(range(len(paramnames)), key = lambda k : paramnames[k])
	sortedparameters = [paramnames[i] for i in sortedindex]
	paramvalues = []
	for p in parameters:
		if p.AsString() != None:
			paramvalues.append(p.AsString())
		else :
			paramvalues.append(p.AsValueString())
	sortedvalues = [paramvalues[i] for i in sortedindex]
	return ', '.join(['%s : %s' % (param,value) for param,value in zip(sortedparameters,sortedvalues)])


geomtest = []
paramtest = []
for eA,eB in zip(elementsA,elementsB):
	try:
		geomtest.append(getvertices(eA) == getvertices(eB))
		paramtest.append(parametersnapshot(eA) == parametersnapshot(eB))
	except:
		pass

samegeometrysameparameters = [i for (i,gt,pt) in zip(elementsA,geomtest,paramtest) if gt and pt]
differentgeometrysameparameters = [i for (i,gt,pt) in zip(elementsA,geomtest,paramtest) if gt == False and pt == True]
samegeometrydifferentparameters = [i for (i,gt,pt) in zip(elementsA,geomtest,paramtest) if gt == True and pt == False]
differentgeometrydifferentparameters = [i for (i,gt,pt) in zip(elementsA,geomtest,paramtest) if gt == False and pt == False]

report = '%d element(s) tested \n%d element(s) with same geometry and parameters, \n%d element(s) with same geometry and different parameters, \n%d element(s) with different geometry and same parameters, \n%d element(s) with different geometry and different parameters' %(len(elementsA),len(samegeometrysameparameters),len(samegeometrydifferentparameters),len(differentgeometrysameparameters), len(differentgeometrydifferentparameters))

OUT = samegeometrysameparameters , samegeometrydifferentparameters , differentgeometrysameparameters, differentgeometrydifferentparameters, report
# ----------------------------------------
code_block = CodeBlock(x=python_script)
# ---------- code_block.designscript (10 lines) ----------
//same geometry and parameters
x[0];
//same geometry different parameter
x[1];
//different geometry and same parameter
x[2];
//different geometry and parameters
x[3];
//report
x[4];
# ----------------------------------------
Report = Output(code_block.out4)
Same_geometry_and_parameter_values = Output(code_block.out0)
Same_geometry_different_parameter_values = Output(code_block.out1)  # "Same geometry, different parameter values"
Different_geometry_same_parameter_values = Output(code_block.out2)  # "Different geometry, same parameter values"
Different_geometry_and_parameter_values = Output(code_block.out3)
