# Dynamo custom node ModificationTracker.GeometryChanges.dyf (Dynamo 2.2.1.5175)
# category: Data-Shapes.ModificationTracker
# Takes ExistingElements Data as input and outputs elements with same geometry and elements with changed geometry . Check out www.Data-Shapes.net for more infos

ExistingElementsData = Input(ExistingElementsData: var[]..[])
SortByCategory = Input(SortByCategory: bool = false)
python_script = Python(IN[0]=ExistingElementsData, IN[1]=SortByCategory)
# ---------- python_script.python (92 lines) ----------
#Copyright (c) mostafa el ayoubi ,  2016
#Data-Shapes www.data-shapes.net , elayoubi.mostafa@gmail.com
#This node was inspired by Jeremy Tammik @Jeremytammik

import clr
clr.AddReference('RevitAPI')
from Autodesk.Revit.DB import*
import sys
pyt_path = r'C:\Program Files (x86)\IronPython 2.7\Lib'
sys.path.append(pyt_path)
import collections

if isinstance(IN[0][0],list):
	elementsA = UnwrapElement(IN[0][0])
	elementsB = UnwrapElement(IN[0][1])
else :
	elementsA = [UnwrapElement(IN[0][0])]
	elementsB = [UnwrapElement(IN[0][1])]

def flatten(l):
    for el in l:
        if isinstance(el, collections.Iterable) and not isinstance(el, basestring):
            for sub in flatten(el):
                yield sub
        else:
            yield el

def tostring(x):
	return x.ToString()
def getgeomlist(x):
	return list(x.get_Geometry(Options()))


def getvertices(x):
	#getting geometryelements as list
	geomelems = getgeomlist(x)
	#getting nested instance geometry for all geometry instances
	while any('GeometryInstance' in g for g in map(tostring,geomelems)):
		for index,i in enumerate(geomelems):
			if 'GeometryInstance' in i.ToString():
				geomelems[index] = i.GetInstanceGeometry()
			else:
				continue
	geomelems = list(flatten(geomelems))
	#getting all faces, keeping meshes
	faces = []
	for i in geomelems:
		if 'Solid' in i.ToString():
			faces.append(list(i.Faces))
		elif 'Mesh' in i.ToString():
			faces.append(i)
		else:
			continue
	faces = list(flatten(faces))
	#getting all meshes
	meshes = []
	for f in faces:
		if 'Mesh' in f.ToString():
			meshes.append(f)
		else:
			meshes.append(f.Triangulate())
	#getting all vertices
	vertexlist = []
	for m in meshes:
		vertexlist.append(list(m.Vertices))
	vertexlist = list(flatten(vertexlist))
	#creating sorted vertex string representation of object for comparison with other indice of element
	vertexstr = ', '.join(sorted(set(map(tostring,vertexlist))))
	return vertexstr



geomtest = []
categories = set([e.Category.Name for e in elementsA])

for eA,eB in zip(elementsA,elementsB):
	geomtest.append(getvertices(eA) == getvertices(eB))

samegeometry = [i for (i,gt) in zip(elementsA,geomtest) if gt]
differentgeometry = [i for (i,gt) in zip(elementsA,geomtest) if not gt]
samegeometrybycat = []
differentgeometrybycat = []
for c in categories:
	samegeometrybycat.append([s for s in samegeometry if s.Category.Name == c])
	differentgeometrybycat.append([d for d in differentgeometry if d.Category.Name == c])
	

report = '%d element(s) tested, \n%d element(s) with same geometry, \n%d element(s) with geometry modifications' %(len(elementsA),len(samegeometry),len(differentgeometry))
if IN[1] == True:
	OUT = samegeometrybycat , differentgeometrybycat , report
else:
	OUT = samegeometry , differentgeometry , report
# ----------------------------------------
code_block = CodeBlock(x=python_script)
# ---------- code_block.designscript (6 lines) ----------
//same geometry
x[0];
//different geometry
x[1];
//report
x[2];
# ----------------------------------------
Report = Output(code_block.out2)
Elements_with_same_geometry = Output(code_block.out0)
Elements_with_changed_geometry = Output(code_block.out1)
