# Dynamo custom node ModificationTracker.ModelComparison.dyf (Dynamo 2.3.0.5885)
# category: Data-Shapes.ModificationTracker
# Compares elements from documents A and B (A is the current document by default) and returns existing elements data, new elements, deleted elements and a report. Check out www.Data-Shapes.net for more infos.

CurrentVersionDocument = Input(CurrentVersionDocument: var = false)  # Most recent version of the model, current document by default
PreviousVersionDocument = Input(PreviousVersionDocument: var[]..[])  # Previous version of the model
Categories = Input(Categories_: var[]..[])
python_script = Python(IN[0]=CurrentVersionDocument, IN[1]=PreviousVersionDocument, IN[2]=Categories)
# ---------- python_script.python (68 lines) ----------
#Copyright (c) mostafa el ayoubi ,  2016
#Data-Shapes www.data-shapes.net , elayoubi.mostafa@gmail.com

import clr
clr.AddReference('RevitAPI')
from Autodesk.Revit.DB import*
clr.AddReference('RevitServices')
from RevitServices.Persistence import DocumentManager
import System
from System.Collections.Generic import*

if IN[0] == False:
	docA = DocumentManager.Instance.CurrentDBDocument
else:
	docA = IN[0]
docB = IN[1]
CategorySet = IN[2]

def reportformat(x):
	val = [UnwrapElement(e).Category.Name for e in x]
	values = set(val)
	newlist = [len([y for y in val if y==x]) for x in values]
	strreport = []
	for i,j in zip(values,newlist):
		strreport.append('%d %s element(s)'%(j,i))
	return ', '.join(strreport)
	
#getting list of categories

if isinstance(IN[2],list):
	categories = IN[2]
else:
	categories = [IN[2]]

#Getting All elements of wanted category set

catfilters = []
for i in categories:
	catfilters.append(ElementCategoryFilter(System.Enum.ToObject(BuiltInCategory, int(str(i.Id)))))


catfilterlist = List[ElementFilter](catfilters)
filter = LogicalOrFilter(catfilterlist)

docAcollector = FilteredElementCollector(docA).WherePasses(filter).WhereElementIsNotElementType().ToElements()
docBcollector = FilteredElementCollector(docB).WherePasses(filter).WhereElementIsNotElementType().ToElements()

#GUID lists

docAguid = [e.UniqueId for e in docAcollector]
docBguid = [e.UniqueId for e in docBcollector]

#Sorting existing elements, new elements and deleted elements

existingguid = [e for e in docAguid if e in docBguid]
newguid = [e for e in docAguid if e not in docBguid]
deletedguid = [e for e in docBguid if e not in docAguid]

existingA = [docA.GetElement(e) for e in existingguid]
existingB = [docB.GetElement(e) for e in existingguid]
new = [docA.GetElement(e) for e in newguid]
deleted = [docB.GetElement(e) for e in deletedguid]
newreport = reportformat(new)
deletedreport = reportformat(deleted)

report = 'The model contains %d elements of the selected categories, there are %d new elements and %d deleted elements compared to the previous indice. \nNew elements : ' %(len(docAcollector),len(new),len(deleted)) + newreport + '\nDeleted elements : ' + deletedreport

OUT = (existingA, existingB) ,  new, deleted, report
# ----------------------------------------
code_block = CodeBlock(x=python_script)
# ---------- code_block.designscript (8 lines) ----------
//existing elements
x[0];
//new
x[1];
//deleted
x[2];
//report
x[3];
# ----------------------------------------
Report = Output(code_block.out3)
ExistingElements_Data = Output(code_block.out0)
New_elements = Output(code_block.out1)
Deleted_elements = Output(code_block.out2)
