# Dynamo custom node ModificationTracker.ParameterChanges.dyf (Dynamo 2.2.1.5175)
# category: Data-Shapes.ModificationTracker
# takes ExistingElements Data as input and outputs elements with same parameter values and elements with changed parameter values. Check out www.Data-Shapes.net for more infos.

ExistingElementsData = Input(ExistingElementsData: var[]..[])
python_script = Python(IN[0]=ExistingElementsData)
# ---------- python_script.python (45 lines) ----------
#Copyright (c) mostafa el ayoubi ,  2016
#Data-Shapes www.data-shapes.net , elayoubi.mostafa@gmail.com
#This node was inspired by Jeremy Tammik @Jeremytammik

import clr
clr.AddReference('RevitAPI')
from Autodesk.Revit.DB import*
clr.AddReference('RevitServices')
from RevitServices.Persistence import DocumentManager

doc = DocumentManager.Instance.CurrentDBDocument

if isinstance(IN[0][0],list):
	elementsA = UnwrapElement(IN[0][0])
	elementsB = UnwrapElement(IN[0][1])
else :
	elementsA = [UnwrapElement(IN[0][0])]
	elementsB = [UnwrapElement(IN[0][1])]



def parametersnapshot(x):
	parameters = x.Parameters
	paramnames = [p.Definition.Name for p in parameters]
	sortedindex = sorted(range(len(paramnames)), key = lambda k : paramnames[k])
	sortedparameters = [paramnames[i] for i in sortedindex]
	paramvalues = []
	for p in parameters:
		if p.AsString() != None:
			paramvalues.append(p.AsString())
		else :
			paramvalues.append(p.AsValueString())
	sortedvalues = [paramvalues[i] for i in sortedindex]
	return ', '.join(['%s : %s' % (param,value) for param,value in zip(sortedparameters,sortedvalues)])

paramtest = []
for a,b in zip(elementsA , elementsB):
	paramtest.append(parametersnapshot(a) == parametersnapshot(b))

differentparameters  = [i for (i,m) in zip(elementsA,paramtest) if not m]
sameparameters = [i for (i,m) in zip(elementsA,paramtest) if m]

report = '%d element(s) tested, \n%d element(s) with same parameters, \n%d element(s) with parameter modifications' %(len(elementsA),len(sameparameters),len(differentparameters))

OUT = sameparameters, differentparameters, report
# ----------------------------------------
code_block = CodeBlock(x=python_script)
# ---------- code_block.designscript (6 lines) ----------
//same parameters
x[0];
//different parameters
x[1];
//report
x[2];
# ----------------------------------------
Report = Output(code_block.out2)
Elements_with_same_parameter_values = Output(code_block.out0)
Elements_with_changed_parameter_values = Output(code_block.out1)
