# Dynamo custom node MultiLanguage IO.dyf (Dynamo 2.0.2.6826)
# category: Data-Shapes.Language
# Takes inputs in different languages and returns the version that corresponds to the active Revit application language settings.

ENU = Input(ENU: string = "")
FRA = Input(FRA: string = "")
DEU = Input(DEU: string = "")
ITA = Input(ITA: string = "")
python_script = Python(IN[0]=ENU, IN[1]=FRA, IN[2]=DEU, IN[3]=ITA)
# ---------- python_script.python (24 lines) ----------
#Copyright (c) Data Shapes,  2019
#Data-Shapes www.data-shapes.net , elayoubi.mostafa@data-shapes.io @data_shapes
import clr

clr.AddReference('RevitServices')
import RevitServices
from RevitServices.Persistence import DocumentManager
doc = DocumentManager.Instance.CurrentDBDocument
uiapp = DocumentManager.Instance.CurrentUIApplication
app = uiapp.Application
clr.AddReference('RevitAPI')
import Autodesk
from Autodesk.Revit.DB import *

lang = app.Language

if str(lang) == 'French':
   OUT = IN[1]
elif str(lang) == 'German':
   OUT = IN[2]
elif str(lang) == 'Italian':
	OUT = IN[3]
else :
   OUT = IN[0]
# ----------------------------------------
InActiveRevitLanguage = Output(python_script)
