# Dynamo custom node MultiLineTextBox Data.dyf (Dynamo 2.0.2.6826)
# category: Data-Shapes.UI.Input
# Creates a multi line textbox input for UI.MultipleInputForm ++

InputName = Input(InputName: string = "")
InputName_2 = Input(InputName: string = "")
IsNumberEntry = Input(IsNumberEntry: bool = false)
Height_Optionnal = Input(Height_Optionnal: int = 100)
python_script = Python(IN[0]=InputName, IN[1]=InputName_2, IN[2]=IsNumberEntry, IN[3]=Height_Optionnal)
# ---------- python_script.python (18 lines) ----------
#Copyright (c) mostafa el ayoubi ,  2018
#Data-Shapes www.data-shapes.net , elayoubi.mostafa@gmail.com

class uimultilinetext():

    def __init__(self,inputname,defaultvalue,_isnum,_height):
        self.inputname = inputname
        self.defaultvalue = defaultvalue
        self._isnum = _isnum
        self._height = _height

    def __repr__(self):
        return 'UI.MultiLineTextbox input'
        
x = uimultilinetext(IN[0],IN[1],IN[2],IN[3])


OUT = x
# ----------------------------------------
MultiLineTextBox_input = Output(python_script)
