# Dynamo custom node Number to Rounded String .dyf "Number to Rounded String" (Dynamo 2.0.2.6826)
# category: Data-Shapes.Utilities
# Returns rounded number to specified number of decimals as string

Number = Input(Number: var[]..[])
Decimals = Input(Decimals: int = 2)
python_script = Python(IN[0]=Number, IN[1]=Decimals)
# ---------- python_script.python (18 lines) ----------
import clr
import sys
pyt_path = r'C:\Program Files (x86)\IronPython 2.7\Lib'
sys.path.append(pyt_path)
from decimal import Decimal

def tolist(input):
	if isinstance(input,list):
		return input
	else:
		return [input]
		
nums = tolist(IN[0])

if IN[1] != 0 :	
	OUT = [str(round(Decimal(n),IN[1])) for n in nums]
else:
	OUT = [str(int(round(Decimal(n),IN[1]))) for n in nums]
# ----------------------------------------
string = Output(python_script)
