# Dynamo custom node ParameterGroup list.dyf (Dynamo 2.0.2.6826)
# category: Data-Shapes.Revit.SharedParameters
# List of all parameter groups

python_script = Python()  # graph input
# ---------- python_script.python (9 lines) ----------
#Copyright (c) mostafa el ayoubi
#Data-Shapes www.data-shapes.net 2017 elayoub.mostafa@gmail.com

import clr
clr.AddReference('RevitAPI')
from Autodesk.Revit.DB import*
import System

OUT = System.Enum.GetValues(BuiltInParameterGroup)
# ----------------------------------------
ParameterGroups = Output(python_script)
