# Dynamo custom node PerformanceAdviserRule Elements.dyf (Dynamo 2.0.3.8810)
# category: Data-Shapes.Revit.Elements
# Gets all elements relative to a performance adviser rule.

PerformanceAdviserRule = Input(PerformanceAdviserRule_: var[]..[])
Refresh = Input(Refresh: bool)
python_script = Python(IN[0]=PerformanceAdviserRule, IN[1]=Refresh)
# ---------- python_script.python (31 lines) ----------
#Copyright (c) mostafa el ayoubi ,  2017
#Data-Shapes www.data-shapes.net , elayoubi.mostafa@gmail.com

import clr
clr.AddReference('RevitAPI')
from Autodesk.Revit.DB import*
clr.AddReference('RevitServices')
from RevitServices.Persistence import DocumentManager
from RevitServices.Transactions import TransactionManager
clr.AddReference('RevitAPIUI')
from Autodesk.Revit.UI import*
import System
from System.Collections.Generic import*


doc = DocumentManager.Instance.CurrentDBDocument
app = DocumentManager.Instance.CurrentUIApplication
pa = PerformanceAdviser.GetPerformanceAdviser()
allrules = pa.GetAllRuleIds()
inputrule = IN[0].Name
r = [a for a in allrules if pa.GetRuleName(a) == inputrule]
rules = List[PerformanceAdviserRuleId]()
[rules.Add(i) for i in r]
failmess = pa.ExecuteRules(doc,rules)
elementids = [d.GetFailingElements() for d in failmess]
elements = []

for e in elementids:
    elems = [doc.GetElement(id) for id in e]
    elements.append(elems)
OUT =  elements
# ----------------------------------------
Elements = Output(python_script)
