# Dynamo custom node PerspectiveView.ByEyePositionTarget.dyf (Dynamo 2.3.0.5885)
# category: Data-Shapes.Revit.View
# Create perspective view

ViewFamilyTypesName = Input(ViewFamilyTypesName: string)
EyePositions = Input(EyePositions: Autodesk.DesignScript.Geometry.Point)
TargetPositions = Input(TargetPositions: Autodesk.DesignScript.Geometry.Point)
ViewTemplates = Input(ViewTemplates_: var = null)
python_script = Python(IN[0]=ViewFamilyTypesName, IN[1]=EyePositions, IN[2]=TargetPositions, IN[3]=ViewTemplates)
# ---------- python_script.python (59 lines) ----------
import clr
clr.AddReference('RevitAPI')
from Autodesk.Revit.DB import*
clr.AddReference('RevitServices')
from RevitServices.Persistence import DocumentManager
from RevitServices.Transactions import TransactionManager
clr.AddReference('RevitNodes')
import Revit
clr.ImportExtensions(Revit.Elements)
clr.AddReference('ProtoGeometry')
from Autodesk.DesignScript.Geometry import*

doc = DocumentManager.Instance.CurrentDBDocument
UIunit = Document.GetUnits(doc).GetFormatOptions(UnitType.UT_Length).DisplayUnits

def convert(x):
	return  UnitUtils.ConvertToInternalUnits(x,UIunit)

ftypecollection = FilteredElementCollector(doc).OfClass(ViewFamilyType).ToElements()

if isinstance(IN[0],list):
	viewfamilytypes = IN[0]
else:
	viewfamilytypes = [IN[0]]
if isinstance(IN[1],list):
	eyepositions = IN[1]
else:
	eyepositions = [IN[1]]
if isinstance(IN[2],list):
	targets = IN[2]
else:
	targets = [IN[2]]
if isinstance(IN[3],list):
	templates = IN[3]
else:
	templates = [IN[3]]

views = []

for vft,ep,t,temp in zip(viewfamilytypes,eyepositions,targets,templates):
	ftype = [f for f in ftypecollection if f.ToDSType(True).Name == vft][0]
	persview = View3D.CreatePerspective(doc,ftype.Id)
	eyeposition = XYZ(convert(ep.X),convert(ep.Y),convert(ep.Z))
	vforward = Vector.ByTwoPoints(ep,t)
	lforward = Line.ByStartPointEndPoint(ep,t)
	normal = lforward.NormalAtParameter(0)
	forwarddirection = XYZ(convert(vforward.X),convert(vforward.Y),convert(vforward.Z))
	up = normal.Cross(vforward)
	updirection = XYZ(convert(up.X),convert(up.Y),convert(up.Z))
	orientation = ViewOrientation3D(eyeposition,updirection,forwarddirection)
	persview.SetOrientation(orientation)
	persview.SaveOrientation()
	if temp != None:
		persview.ViewTemplateId = temp.Id
	else:
		pass
	views.append(persview)

OUT = views
# ----------------------------------------
OUT = Output(python_script)
