# Dynamo custom node PieChart.dyf (Dynamo 2.0.3.8810)
# category: Data-Shapes.UI.Charts
# PieChart

Chart_name = Input(Chart_name: string = "Pie Chart")
series = Input(series: var[]..[])
values = Input(values: var[]..[])
Chart_colors_optionnal = Input(Chart_colors_optionnal: var[] = null)
python_script = Python(IN[0]=Chart_name, IN[1]=series, IN[2]=values, IN[3]=Chart_colors_optionnal)
# ---------- python_script.python (17 lines) ----------
#Copyright (c) valentin bertel ,  2019
#Data-Shapes www.data-shapes.io

class uipiechart():
	def __init__(self,inputname,chartname,xseries,yseries,inputcolors):
		self.inputname = inputname
		self.chartname = chartname
		self.xseries = xseries
		self.yseries = yseries
		self.inputcolors = inputcolors
		
	def __repr__(self):
		return 'UI.PieChart input'
		
x = uipiechart("",IN[0],IN[1],IN[2],IN[3])

OUT = x
# ----------------------------------------
UI_PieChart_Data = Output(python_script)  # "UI.PieChart Data"
