# Dynamo custom node RayBounce On Linked Model.dyf (Dynamo 2.10.1.3976)
# category: Data-Shapes.Revit.RayBounce
# Same functionality as raybounce but takes linked model elements into account

Points = Input(Points_: Autodesk.DesignScript.Geometry.Point[])
Direction = Input(Direction: Autodesk.DesignScript.Geometry.Vector)
ThreeDView = Input(ThreeDView: Revit.Elements.Views.View3D)
BounceOnLinkOnly = Input(BounceOnLinkOnly: bool = true)
python_script = Python(IN[0]=Points, IN[1]=Direction, IN[2]=ThreeDView, IN[3]=BounceOnLinkOnly)  # IronPython2
# ---------- python_script.python (63 lines) ----------
#Copyright (c) mostafa el ayoubi
#Node-mode www.data-shapes.net 2016 elayoub.mostafa@gmail.com

import clr
clr.AddReference('RevitAPI')
from Autodesk.Revit.DB import*

clr.AddReference('ProtoGeometry')
from Autodesk.DesignScript.Geometry import *

clr.AddReference('RevitServices')
from RevitServices.Persistence import DocumentManager


doc = DocumentManager.Instance.CurrentDBDocument

#Document UI Units

try:
	UIunit = Document.GetUnits(doc).GetFormatOptions(UnitType.UT_Length).DisplayUnits
except:
	UIunit = Document.GetUnits(doc).GetFormatOptions(SpecTypeId.Length).GetUnitTypeId()


#Inputs : Points, Direction, 3D View
if isinstance(IN[0],list):
	points = [XYZ(UnitUtils.ConvertToInternalUnits(i.X,UIunit),UnitUtils.ConvertToInternalUnits(i.Y,UIunit),UnitUtils.ConvertToInternalUnits(i.Z,UIunit)) for i in IN[0]]
else:
	points = [XYZ(UnitUtils.ConvertToInternalUnits(IN[0].X,UIunit),UnitUtils.ConvertToInternalUnits(IN[0].Y,UIunit),UnitUtils.ConvertToInternalUnits(IN[0].Z,UIunit))]

direction = XYZ(IN[1].X,IN[1].Y,IN[1].Z)
view = UnwrapElement(IN[2])

ex = []
pts = []
elems = []

ri = ReferenceIntersector(view)
ri.FindReferencesInRevitLinks = True

for p in points:
	ref = ri.FindNearest(p,direction)
	if ref == None:
		pts.append(None)
		elems.append(None)
	else:
		refel = ref.GetReference()
		linkinstance = doc.GetElement(refel.ElementId)
		try:
			elem = linkinstance.GetLinkDocument().GetElement(refel.LinkedElementId)
			elems.append(elem)
			refp = ref.GetReference().GlobalPoint
			pts.append(Point.ByCoordinates(UnitUtils.ConvertFromInternalUnits(refp.X,UIunit),UnitUtils.ConvertFromInternalUnits(refp.Y,UIunit),UnitUtils.ConvertFromInternalUnits(refp.Z,UIunit)))
		except:
			if not IN[3]:
				elems.append(linkinstance)
				refp = ref.GetReference().GlobalPoint
				pts.append(Point.ByCoordinates(UnitUtils.ConvertFromInternalUnits(refp.X,UIunit),UnitUtils.ConvertFromInternalUnits(refp.Y,UIunit),UnitUtils.ConvertFromInternalUnits(refp.Z,UIunit)))
			else:
				pass


OUT = pts , elems
# ----------------------------------------
code_block = CodeBlock(x=python_script) { x[0]; x[1]; }
Points_2 = Output(code_block.out0)  # "Points"
Elements = Output(code_block.out1)
