# Dynamo custom node Replace viewports by center.dyf (Dynamo 2.3.0.5885)
# category: Data-Shapes.Revit.Sheets
# Replaces vieports on sheets according to list of points. (0,0) is bottom left of sheets

Sheets = Input(Sheets_: var[]..[])
code_block = CodeBlock(x=Sheets) { DSCore.List.Flatten([x]); }
Points = Input(Points: var[])
python_script = Python(IN[0]=code_block, IN[1]=Points)
# ---------- python_script.python (42 lines) ----------
#Copyright (c) mostafa el ayoubi
#Data-Shapes 2016 elayoub.mostafa@gmail.com


import clr
clr.AddReference('RevitApi')
from Autodesk.Revit.DB import*
clr.AddReference('RevitServices')
from RevitServices.Persistence import DocumentManager
from RevitServices.Transactions import TransactionManager

doc = DocumentManager.Instance.CurrentDBDocument

def toList(input):
	if isinstance(input,list) : return UnwrapElement(input)
	else: return [UnwrapElement(input)]
UIunit = Document.GetUnits(doc).GetFormatOptions(UnitType.UT_Length).DisplayUnits
def convunit(x):
	return UnitUtils.ConvertToInternalUnits(x,UIunit)
def bbLength(bb):
	p = bb.Max-bb.Min
	return p.X/2
	
pts = IN[1]
sheets = toList(IN[0])
viewports = []
centers = []

TransactionManager.Instance.EnsureInTransaction(doc)

for s in sheets:
	vpid = s.GetAllViewports()
	for id in vpid:
		viewports.append(doc.GetElement(id))
for p in pts:
	centers.append(XYZ(convunit(p.X),convunit(p.Y),convunit(p.Z)))

for indice,vp in enumerate(viewports):
	vp.SetBoxCenter(centers[indice]+XYZ(bbLength(UnwrapElement(vp).get_BoundingBox(doc.GetElement(vp.SheetId))),0,0))
TransactionManager.Instance.TransactionTaskDone

OUT = 'You have successfully recentered %d viewports.' % (len(viewports))
# ----------------------------------------
OUT = Output(python_script)
