# Dynamo custom node Room_Group_Outline.dyf (Dynamo 2.12.1.8246)
# category: Data-Shapes.Revit.Rooms
# Returns the outline of the inpu rooms, grouped by the value of the "Grouping Parameter"

GroupingParameter = Input(GroupingParameter: var[]..[])
Rooms = Input(Rooms_: var[]..[])
Offset = Input(Offset_: var[]..[])
ExtendCircular = Input(ExtendCircular: bool = false)
python_script = Python(IN[0]=GroupingParameter, IN[1]=Rooms, IN[2]=Offset, IN[3]=ExtendCircular)  # IronPython2
# ---------- python_script.python (145 lines) ----------
# Enable Python support and load DesignScript library
import clr
clr.AddReference('RevitAPI')
from Autodesk.Revit.DB import *
from Autodesk.Revit.DB import UV as AUV

clr.AddReference('ProtoGeometry')
from Autodesk.DesignScript.Geometry import *

clr.AddReference('RevitServices')
from RevitServices.Persistence import DocumentManager
from RevitServices.Transactions import TransactionManager

import System
from System.Collections.Generic import*

clr.AddReference('RevitNodes')
import Revit
clr.ImportExtensions(Revit.Elements)
clr.ImportExtensions(Revit.GeometryConversion)

doc = DocumentManager.Instance.CurrentDBDocument
rooms =  UnwrapElement(IN[1])
names = [r.get_Parameter(BuiltInParameter.ROOM_NAME).AsString() for r in rooms]

Arooms = [r.LookupParameter(IN[0]).AsString() for r in rooms]
uniqueVals = list(set(Arooms))


#Document UI Units

try:
	UIunit = Document.GetUnits(doc).GetFormatOptions(UnitType.UT_Length).DisplayUnits
except:
	UIunit = Document.GetUnits(doc).GetFormatOptions(SpecTypeId.Length).GetUnitTypeId()
offsetV = IN[2]

offV = UnitUtils.ConvertToInternalUnits(offsetV,UIunit)


def roomSolidOffsetProtocore(room):
	bop = SpatialElementBoundaryOptions()
	bop.SpatialElementBoundaryLocation = SpatialElementBoundaryLocation.Center
	bounds = room.GetBoundarySegments(bop) 
	l = []
	for boundList in bounds:
		dscurves = []
		for boundary in boundList:
			dscurves.append(boundary.GetCurve().ToProtoType())
		l.append(PolyCurve.ByJoinedCurves(dscurves))
	sorted(l,key = lambda x : x.Length)
	biggestcl = l[0].Offset(offV,False)
	rsol = biggestcl.ExtrudeAsSolid(1)
	return rsol

def roomSolidOffset(room):
	bop = SpatialElementBoundaryOptions()
	bop.SpatialElementBoundaryLocation = SpatialElementBoundaryLocation.Center
	bounds = room.GetBoundarySegments(bop) 
	l = List[CurveLoop]()
	for boundList in bounds:
		vcLoop = CurveLoop()
		for boundary in boundList:
			vcLoop.Append(boundary.GetCurve())
		l.Add(vcLoop)
	sorted(l,key = lambda x : x.GetExactLength() * -1)
	biggestcl = List[CurveLoop]()
	biggestcl.Add(CurveLoop.CreateViaOffset(l[0],1 + offV ,XYZ.BasisZ))
	rsol = GeometryCreationUtilities.CreateExtrusionGeometry(biggestcl, XYZ(0, 0, 1),1)
	return rsol

def solidBottomFaces(solid):	
	try:
		faces = solid.Faces
		bottomFaces = [face  for face in faces if face.ComputeNormal(AUV(0.5,0.5)).Z < -0.5]
	except:
		faces = solid.Explode()
		bottomFaces = [face for face in faces if face.NormalAtParameter(0.5,0.5).Z < -0.5]
	return bottomFaces

def unionSolids(solids):
	try:
		union = solids[0]
		for solid in solids:
			union = BooleanOperationsUtils.ExecuteBooleanOperation(union, solid, BooleanOperationsType.Union)
	except:
		union = Solid.ByUnion(solids)
	return union
	
def counterOffsetCvLoop(face):
	botCvLoops = face.GetEdgesAsCurveLoops()
	minOffset = []
	for CvLoop in botCvLoops:
		unoffCvLoop = CurveLoop.CreateViaOffset(CvLoop,1,XYZ.BasisZ)
		for cv in unoffCvLoop:
			minOffset.append(cv)
	return minOffset
	
def counterOffsetCvLoopProtoCore(face):
	if isinstance(face,list):
		dsfaces = face
	else:
		dsfaces = [face]
	cvs = [SurfaceExternalBoundary(dsface) for dsface in dsfaces]
	pcs = [PolyCurve.ByJoinedCurves(cv) for cv in cvs]
	offsetcvs = [pc.Offset(-offV,IN[3]) for pc in pcs]
	return [offsetcv.Explode() for offsetcv in offsetcvs]

def SurfaceExternalBoundary(surface):
	outerloop = [lp for lp in surface.Faces[0].Loops if lp.IsExternal][0]
	return [cv.Edge.CurveGeometry for cv in outerloop.CoEdges]
	
outlines = []
groupingValues = []
def computeRoomsForUniqueVal(val):
	grouped = [r for r in rooms if r.LookupParameter(IN[0]).AsString() == val]
	try:
		offsetRooms = [ roomSolidOffset(r) for r in grouped]		
	except:
		offsetRooms = [roomSolidOffsetProtocore(r) for r in grouped]
	globalSolid = unionSolids(offsetRooms)	
	botFaces = solidBottomFaces(globalSolid)
	try:
		cvloops = [counterOffsetCvLoop(f) for f in botFaces]
		dsCurves = []	
		cvArray = CurveArray()
		for cvl in cvloops:
			for cv in cvl:
				cvArray.Append(cv)
		for loop in cvloops:
			for cv in loop:
				dsCurves.append(cv.ToProtoType())
	except:
		dsCurves = counterOffsetCvLoopProtoCore(botFaces)
	return dsCurves

		

for val in uniqueVals:
	outline = computeRoomsForUniqueVal(val)
	outlines.append(outline)	
	groupingValues.append(val)

		
OUT = outlines , groupingValues 
# ----------------------------------------
code_block = CodeBlock(x=python_script) { x[0]; x[1]; }
CurveLists = Output(code_block.out0)
GroupingValues = Output(code_block.out1)
