# Dynamo custom node Select Face (s) (PickObject).dyf (Dynamo 2.0.2.6826)
# category: Data-Shapes.Revit.Selection
# Same as OOTB Select Faces, but can be used through Dynamo Player

Refresh = Input(Refresh: bool = true)
python_script = Python(IN[0]=Refresh)
# ---------- python_script.python (31 lines) ----------
#Copyright (c) mostafa el ayoubi
#Node-mode www.data-shapes.net 2016 elayoub.mostafa@gmail.com

import clr

clr.AddReference('RevitAPI')
from Autodesk.Revit.DB import*
clr.AddReference('RevitServices')
from RevitServices.Persistence import DocumentManager
clr.AddReference('RevitNodes')
import Revit
clr.AddReference('RevitAPIUI')
from Autodesk.Revit.UI.Selection import ObjectType
clr.ImportExtensions(Revit.Elements)
clr.ImportExtensions(Revit.GeometryConversion)

doc = DocumentManager.Instance.CurrentDBDocument
uidoc = DocumentManager.Instance.CurrentUIApplication.ActiveUIDocument
faces = []
dsfaces = []

faces.append(uidoc.Selection.PickObjects(ObjectType.Face,'Select Faces'))
for f in faces:
	for r in f:
		e = uidoc.Document.GetElement(r)
		dsface = e.GetGeometryObjectFromReference(r).ToProtoType(True)
		[f.Tags.AddTag("RevitFaceReference", r) for f in dsface]
		dsfaces.append(dsface)

		
OUT = dsfaces
# ----------------------------------------
Faces = Output(python_script)
