# Dynamo custom node SelectModelElements Data (ordered).dyf (Dynamo 2.6.1.8786)
# category: Data-Shapes.UI.Selection
# Creates a Revit element selection input for UI.MultipleInputForm++ . Check out www.data-shapes.net for more infos!

InputName = Input(InputName_: string = "")
ButtonText = Input(ButtonText_: string = "Select Model Element(s)")
CategoryFilter = Input(CategoryFilter_: var[] = "")
python_script = Python(IN[0]=InputName, IN[1]=ButtonText, IN[2]=CategoryFilter)
# ---------- python_script.python (41 lines) ----------
#Copyright (c) Data Shapes ,  2018
#Data-Shapes www.data-shapes.net , elayoubi.mostafa@gmail.com
#This node was inspired by @DanielHurtubise

class uiselectOrderedelements():

    def __init__(self,inputname,buttontext):
        self.inputname = inputname
        self.buttontext = buttontext

    def __repr__(self):
        return 'UI.SelectOrderedElements input'



class uiselectOrderedelementsofcat():

    def __init__(self,inputname,buttontext,category):
        self.inputname = inputname
        self.buttontext = buttontext
        self.category = category

    def __repr__(self):
        return 'UI.SelectOrderedElementsOfCategory input'

if IN[2] == [""]:
	x = uiselectOrderedelements(IN[0],IN[1])
else:
	if isinstance(IN[2],list):
		catnames = ', '.join([UnwrapElement(i).Name for i in IN[2]])
		if IN[1] == "Select Model Element(s)":
			buttontext = 'Select %s' %(catnames)
		else:
			buttontext = IN[1]
	else:
		buttontext = IN[1]
		
	x = uiselectOrderedelementsofcat(IN[0],buttontext,IN[2])


OUT = x
# ----------------------------------------
SelectOrderedModelElements_input = Output(python_script)
