# Dynamo custom node SelectModelElements Data.dyf (Dynamo 2.6.1.8786)
# category: Data-Shapes.UI.Selection
# Creates a Revit element selection input for UI.MultipleInputForm++ . Check out www.data-shapes.net for more infos!

InputName = Input(InputName_: string = "")
ButtonText = Input(ButtonText_: string = "Select Model Element(s)")
CategoryFilter = Input(CategoryFilter_: var[] = "")
SelectSingleElement = Input(SelectSingleElement_: bool = false)
python_script = Python(IN[0]=InputName, IN[1]=ButtonText, IN[2]=CategoryFilter, IN[3]=SelectSingleElement)
# ---------- python_script.python (43 lines) ----------
#Copyright (c) mostafa el ayoubi ,  2017
#Data-Shapes www.data-shapes.net , elayoubi.mostafa@gmail.com
#This node was inspired by @DanielHurtubise

class uiselectelements():

    def __init__(self,inputname,buttontext,multi):
        self.inputname = inputname
        self.buttontext = buttontext
        self.multi = multi

    def __repr__(self):
        return 'UI.SelectElements input'



class uiselectelementsofcat():

    def __init__(self,inputname,buttontext,category,multi):
        self.inputname = inputname
        self.buttontext = buttontext
        self.category = category
        self.multi = multi

    def __repr__(self):
        return 'UI.SelectElementsOfCategory input'

if IN[2] == [""]:
	x = uiselectelements(IN[0],IN[1],IN[3])
else:
	if isinstance(IN[2],list):
		catnames = ', '.join([UnwrapElement(i).Name for i in IN[2]])
		if IN[1] == "Select Model Element(s)":
			buttontext = 'Select %s' %(catnames)
		else:
			buttontext = IN[1]
	else:
		buttontext = IN[1]
		
	x = uiselectelementsofcat(IN[0],buttontext,IN[2],IN[3])


OUT = x
# ----------------------------------------
SelectModelElements_input = Output(python_script)
