# Dynamo custom node SelectPointsOnFace data.dyf (Dynamo 2.0.2.6826)
# category: Data-Shapes.UI.Selection
# Creates a UI.MultipleInputForm++ input that allows point on face selection

InputName = Input(InputName: string = "")
ButtonText = Input(ButtonText: string = "Select point(s) on face")
python_script = Python(IN[0]=InputName, IN[1]=ButtonText)
# ---------- python_script.python (15 lines) ----------
#Copyright (c) mostafa el ayoubi ,  2016
#Data-Shapes www.data-shapes.net , elayoubi.mostafa@gmail.com

class uiselectpointsonface():

    def __init__(self,inputname,buttontext):
        self.inputname = inputname
        self.buttontext = buttontext
        
    def __repr__(self):
        return 'UI.SelectPointsOnFace input'
x = uiselectpointsonface(IN[0],IN[1])


OUT = x
# ----------------------------------------
SelectPointOnFace_input = Output(python_script)
