# Dynamo custom node SetCropRegion.dyf (Dynamo 2.3.0.5885)
# category: Data-Shapes.Revit.View
# Sets the crop region of a view to a closed polycurve.

view = Input(view_: var[]..[])
CurvesAsList = Input(CurvesAsList: var[]..[])
python_script = Python(IN[0]=view, IN[1]=CurvesAsList)
# ---------- python_script.python (53 lines) ----------
import clr

clr.AddReference('RevitNodes')
import Revit
clr.ImportExtensions(Revit.GeometryConversion)
clr.ImportExtensions(Revit.Elements)

clr.AddReference('RevitAPI')
import Autodesk
from Autodesk.Revit.DB import *

clr.AddReference('RevitServices')
import RevitServices
from RevitServices.Persistence import DocumentManager
from RevitServices.Transactions import TransactionManager

doc = DocumentManager.Instance.CurrentDBDocument

#prepare input

def tolist(input):
	if isinstance(input,list):
		return input
	else:
		return [input]
		
		
views = UnwrapElement(tolist(IN[0]))
curveslist = tolist(IN[1])


def cropView(view,curves):
	#Create curveloop
	loop = CurveLoop()
	for c in curves:
		loop.Append(c.ToRevitType())
		
	#Set cropregion in Transaction
	TransactionManager.Instance.EnsureInTransaction(doc)
	view.CropBoxActive = True
	view.GetCropRegionShapeManager().SetCropShape(loop)
	TransactionManager.Instance.TransactionTaskDone()
	
failed = []

for v,c in zip(views,curveslist):
	try:
		cropView(v,c)
	except:
		failed.append(c)
		

OUT = views , failed
# ----------------------------------------
Outlines = Output(python_script)  # "Outlines_"
