# Dynamo custom node SheetTitleblock.dyf (Dynamo 2.2.1.5175)
# category: Data-Shapes.Revit.Sheets
# Get the TitleBlock family type from a sheet

sheet = Input(sheet_: var[]..[])
python_script = Python(IN[0]=sheet)
# ---------- python_script.python (27 lines) ----------
#Copyright (c) mostafa el ayoubi ,  2019 , @data_shapes
#Data-Shapes www.data-shapes.io , mostafa.elayoubi@data-shapes.io
import clr
clr.AddReference('RevitAPI')
from Autodesk.Revit.DB import *
clr.AddReference('RevitServices')
from RevitServices.Persistence import DocumentManager
doc = DocumentManager.Instance.CurrentDBDocument
output = []

from RevitServices.Transactions import TransactionManager
TransactionManager.Instance.ForceCloseTransaction

def toList(input):
	if isinstance(input,list):
		return input
	else:
		return [input]

viewsheets = toList(IN[0])
tblocks = FilteredElementCollector(doc).OfCategory(BuiltInCategory.OST_TitleBlocks).ToElements()

for v in viewsheets:
	viewtb = [tb.Symbol for tb in tblocks if tb.OwnerViewId.IntegerValue == v.Id]	
	output.append(viewtb)

OUT = output
# ----------------------------------------
TitleBlockFamilyType = Output(python_script)
