# Dynamo custom node Sheet_Titleblock.dyf (Dynamo 2.3.0.5885)
# category: Data-Shapes.Revit.Sheets
# Gets the titleblock used in a Sheet

Sheet = Input(Sheet_: var[]..[])
python_script = Python(IN[0]=Sheet)
# ---------- python_script.python (38 lines) ----------
#Copyright (c) mostafa el ayoubi ,  2020
#Data-Shapes www.data-shapes.io , mostafa.elayoubi@data-shapes.io

import clr
clr.AddReference('RevitAPI')
from Autodesk.Revit.DB import *
clr.AddReference('RevitServices')
from RevitServices.Persistence import DocumentManager
doc = DocumentManager.Instance.CurrentDBDocument
output = []

from RevitServices.Transactions import TransactionManager
TransactionManager.Instance.ForceCloseTransaction

def toList(input):
	if isinstance(input,list):
		return input
	else:
		return [input]

viewsheets = toList(IN[0])
instance = []
familyTypes = []
families = []
titleblocks = FilteredElementCollector(doc).OfCategory(BuiltInCategory.OST_TitleBlocks).ToElements()

for v in viewsheets:
	try:
		viewtb = [tb for tb in titleblocks if tb.OwnerViewId.IntegerValue == v.Id][0]
		famSymbol = viewtb.Symbol
		instance.append(viewtb)
		familyTypes.append(famSymbol)
		families.append(famSymbol.Family)
	except:
		familyTypes.append(None)
		families.append(None)		

OUT = instance,familyTypes, families
# ----------------------------------------
code_block = CodeBlock(x=python_script) { x[0]; x[1]; x[2]; }
TitleBlock_FamilyInstance = Output(code_block.out0)
TitleBlock_FamilyType = Output(code_block.out1)
TitleBlock_Family = Output(code_block.out2)
