# Dynamo custom node SlabShape.AddPoints.dyf (Dynamo 2.0.3.8810)
# category: Data-Shapes.Revit.Floors
# Add points to slab shape

FloorElement = Input(FloorElement: var[]..[])
Points = Input(Points_: var[]..[])
ResetSlabShape = Input(ResetSlabShape: bool = false)
python_script = Python(IN[0]=FloorElement, IN[1]=Points, IN[2]=ResetSlabShape)
# ---------- python_script.python (32 lines) ----------
#Copyright (c) mostafa el ayoubi ,  2017
#Data-Shapes www.data-shapes.net , elayoubi.mostafa@gmail.com

import clr
clr.AddReference('RevitAPI')
from Autodesk.Revit.DB import*

clr.AddReference('RevitServices')
from RevitServices.Persistence import DocumentManager
from RevitServices.Transactions import TransactionManager

doc = DocumentManager.Instance.CurrentDBDocument

slab = UnwrapElement(IN[0])
sshape = slab.SlabShapeEditor
pts = IN[1]
_reset = IN[2]

UIunit = Document.GetUnits(doc).GetFormatOptions(UnitType.UT_Length).DisplayUnits

TransactionManager.Instance.EnsureInTransaction(doc)
watch = []
if _reset:
	sshape.ResetSlabShape()
	
for i in pts:
	watch.append(sshape.DrawPoint(XYZ(UnitUtils.ConvertToInternalUnits(i.X,UIunit),UnitUtils.ConvertToInternalUnits(i.Y,UIunit),UnitUtils.ConvertToInternalUnits(i.Z,UIunit))))

TransactionManager.Instance.TransactionTaskDone()


OUT = slab
# ----------------------------------------
OUT = Output(python_script)
