# Dynamo custom node SplineChart.dyf (Dynamo 2.0.3.8810)
# category: Data-Shapes.UI.Charts
# SplineChart

Chart_name = Input(Chart_name: string = "Spline Chart")
Series_names = Input(Series_names: var[]..[])
X_values = Input(X_values: var[]..[])
Y_values = Input(Y_values: var[]..[])
Chart_colors_optionnal = Input(Chart_colors_optionnal: var[] = null)
x_Axis_Label_optionnal = Input(x_Axis_Label_optionnal: string = "")
y_Axis_Label_optionnal = Input(y_Axis_Label_optionnal: string = "")
python_script = Python(IN[0]=Chart_name, IN[1]=Series_names, IN[2]=X_values, IN[3]=Y_values, IN[4]=Chart_colors_optionnal, IN[5]=x_Axis_Label_optionnal, IN[6]=y_Axis_Label_optionnal)
# ---------- python_script.python (21 lines) ----------
#Copyright (c) valentin bertel ,  2019
#Data-Shapes www.data-shapes.io

class uisplinechart():

    def __init__(self,inputname,chartname,labels,xseries,yseries,inputcolors,xaxislabel,yaxislabel):
        self.inputname = inputname
        self.chartname = chartname
        self.labels = labels
        self.xseries = xseries
        self.yseries = yseries
        self.inputcolors = inputcolors
        self.xaxislabel = xaxislabel
        self.yaxislabel = yaxislabel

    def __repr__(self):
        return 'UI.SplineChart input'
        
x = uisplinechart("",IN[0],IN[1],IN[2],IN[3],IN[4],IN[5],IN[6])

OUT = x
# ----------------------------------------
UI_SplineChart_Data = Output(python_script)  # "UI.SplineChart Data"
