# Dynamo custom node TextNote Data.dyf (Dynamo 2.2.1.5175)
# category: Data-Shapes.UI.Input
# Create Data for TextNote input in UI.MultipleInputForm ++ . Check out www.data-shapes.net for more informations

Title = Input(Title: string = "")
TextNote = Input(TextNote_: string)
python_script = Python(IN[0]=Title, IN[1]=TextNote)
# ---------- python_script.python (19 lines) ----------
#Copyright (c) mostafa el ayoubi ,  2016
#Data-Shapes www.data-shapes.net , elayoubi.mostafa@gmail.com

class uitextnote():

    def __init__(self,inputname, title, textnote):
        self.inputname = inputname
        self.title = title
        self.textnote = textnote



    def __repr__(self):
        return 'UI.TextNote input'
        
x = uitextnote("",IN[0],IN[1])


OUT = x
# ----------------------------------------
TextBox_input = Output(python_script)
