# Dynamo custom node Transform.OriginAndVectors.dyf (Dynamo 2.0.2.6826)
# category: Data-Shapes.Revit.Transform
# Gets origin and vetorx of Autodesk.Revit.DB.Transform objects

Transform = Input(Transform: var[]..[])
python_script = Python(IN[0]=Transform)
# ---------- python_script.python (19 lines) ----------
import clr
clr.AddReference('RevitAPI')
from Autodesk.Revit.DB import*
clr.AddReference('RevitNodes')
import Revit
clr.ImportExtensions(Revit.Elements)
clr.ImportExtensions(Revit.GeometryConversion)

if isinstance(IN[0],list):
	transforms = IN[0]
else:
	transforms = [IN[0]]

o = [t.Origin.ToPoint() for t in IN[0]]
x = [t.BasisX.ToVector() for t in IN[0]]
y = [t.BasisY.ToVector() for t in IN[0]]
z = [t.BasisZ.ToVector() for t in IN[0]]

OUT = o,x,y,z
# ----------------------------------------
code_block = CodeBlock(x=python_script) { x[0]; x[1]; x[2]; x[3]; }
Origin = Output(code_block.out0)
BasisX = Output(code_block.out1)
BasisY = Output(code_block.out2)
BasisZ = Output(code_block.out3)
