# Dynamo custom node TreeView input.dyf (Dynamo 2.0.2.6826)
# category: Data-Shapes.UI.Input
# Create a TreeView input for UI.MultipleInputForm ++ . Check out www.data-shapes.net for more infos and tips!

InputName = Input(InputName: string = "")
Data = Input(Data: var[]..[])
FirstItemIsTitle = Input(FirstItemIsTitle: bool = false)
Height = Input(Height: var = 200)
python_script = Python(IN[0]=InputName, IN[1]=Data, IN[2]=FirstItemIsTitle, IN[3]=Height)
# ---------- python_script.python (18 lines) ----------
#Copyright (c) mostafa el ayoubi ,  2016
#Data-Shapes www.data-shapes.net , elayoubi.mostafa@gmail.com

class uitreeview():

    def __init__(self,inputname,datalist,_hastitles,_height):
        self.inputname = inputname
        self.datalist = datalist
        self._hastitles = _hastitles
        self._height = _height

    def __repr__(self):
        return 'UI.TreeView input'
        
x = uitreeview(IN[0],IN[1],IN[2],IN[3])


OUT = x
# ----------------------------------------
UI_TreeView_Data = Output(python_script)  # "UI.TreeView Data"
