# Dynamo custom node View.ViewRange.dyf (Dynamo 2.3.0.5885)
# category: Data-Shapes.Revit.View
# Returns the view range data of a view

Views = Input(Views_: var[])
python_script = Python(IN[0]=Views)
# ---------- python_script.python (48 lines) ----------
#Copyright (c) mostafa el ayoubi  @data_shapes,  2019
#Data-Shapes www.data-shapes.io , mostafa.elayoubi@data-shapes.io 

import clr
clr.AddReference('RevitAPI')
from Autodesk.Revit.DB import*
clr.AddReference('RevitServices')
from RevitServices.Persistence import DocumentManager
doc = DocumentManager.Instance.CurrentDBDocument
import System
from System.Collections.Generic import *

clr.AddReference('ProtoGeometry')
from Autodesk.DesignScript.Geometry import*
doc = DocumentManager.Instance.CurrentDBDocument

#Inputs

if isinstance(IN[0],list):
	views = UnwrapElement(IN[0])
else:
	views = [UnwrapElement(IN[0])]

collector = []

#getting project base point elevation
basepointfilter = ElementCategoryFilter(BuiltInCategory.OST_ProjectBasePoint)
basepoint = FilteredElementCollector(doc).WherePasses(basepointfilter).ToElements()[0]

bpelevation = basepoint.get_Parameter(BuiltInParameter.BASEPOINT_ELEVATION_PARAM).AsDouble()

UIunit = Document.GetUnits(doc).GetFormatOptions(UnitType.UT_Length).DisplayUnits

def ViewRangeInfos(v):
	vr = v.GetViewRange()
	topclip = PlanViewPlane.TopClipPlane
	bottomclip = PlanViewPlane.BottomClipPlane
	cutclip = PlanViewPlane.CutPlane
	toplevel = (doc.GetElement(vr.GetLevelId(topclip)))
	topoffset = UnitUtils.ConvertFromInternalUnits(vr.GetOffset(topclip),UIunit)
	botlevel = (doc.GetElement(vr.GetLevelId(bottomclip)))
	botoffset = UnitUtils.ConvertFromInternalUnits(vr.GetOffset(bottomclip),UIunit)
	cutlevel = (doc.GetElement(vr.GetLevelId(cutclip)))
	cutoffset = UnitUtils.ConvertFromInternalUnits(vr.GetOffset(cutclip),UIunit)
	return toplevel, topoffset, cutlevel , cutoffset , botlevel , botoffset


OUT = [ViewRangeInfos(view) for view in views]
# ----------------------------------------
transpose = List.Transpose(lists=python_script)
code_block = CodeBlock(x=transpose) { x[0]; x[1]; x[2]; x[3]; x[4]; x[5]; }
Top_Clip_Level = Output(code_block.out0)
Top_Clip_Offset = Output(code_block.out1)
Clip_Plane_Level = Output(code_block.out2)
Clip_Plane_Offset = Output(code_block.out3)
Bottom_Plane_Level = Output(code_block.out4)
Bottom_Plane_Offset = Output(code_block.out5)
