# Dynamo custom node ViewLevel.dyf (Dynamo 2.2.1.5175)
# category: Data-Shapes.Revit.View
# gets the level that a view is associated to

View = Input(View_: var[]..[])
python_script = Python(IN[0]=View)
# ---------- python_script.python (21 lines) ----------
# Load the Python Standard and DesignScript Libraries
import sys
import clr
clr.AddReference('RevitAPI')
from Autodesk.Revit.DB import *


def toList(input):
	if isinstance(input,list):
		return UnwrapElement(input)
	else:
		return [UnwrapElement(input)]
		
		
vs = toList(IN[0])

out = []
for v in vs:
	out.append(v.GenLevel)

OUT = out
# ----------------------------------------
OUT = Output(python_script)
