# Dynamo custom node ViewSection.ByLine.dyf (Dynamo 2.10.1.3976)
# category: Data-Shapes.Revit.View
# Create ViewSections in current document from DS Lines.

Curves = Input(Curves: var[])
ViewFamilyType = Input(ViewFamilyType: var[]..[])
ViewSectionHeight = Input(ViewSectionHeight: var[]..[])
OffsetFromLine = Input(OffsetFromLine: var[]..[])
Depth = Input(Depth_: double = 10)
python_script = Python(IN[0]=Curves, IN[1]=ViewFamilyType, IN[2]=ViewSectionHeight, IN[3]=OffsetFromLine, IN[4]=Depth)  # IronPython2
# ---------- python_script.python (79 lines) ----------
import clr
clr.AddReference('RevitAPI')
from Autodesk.Revit.DB import *
clr.AddReference('RevitServices')
from RevitServices.Transactions import TransactionManager
from RevitServices.Persistence import DocumentManager
clr.AddReference('RevitNodes')
import Revit
clr.ImportExtensions(Revit.GeometryConversion)


doc = DocumentManager.Instance.CurrentDBDocument


#Document UI Units
try:
	UIunit = Document.GetUnits(doc).GetFormatOptions(UnitType.UT_Length).DisplayUnits
except:
	UIunit = Document.GetUnits(doc).GetFormatOptions(SpecTypeId.Length).GetUnitTypeId()


def tolist(input):
	if isinstance(input,list):
		return input
	else:
		return [input]




curves = tolist(IN[0])
ViewFamilyType = IN[1]
height = UnitUtils.ConvertToInternalUnits(IN[2],UIunit)
offsetFromWall = UnitUtils.ConvertToInternalUnits(IN[3],UIunit)
depth_ = UnitUtils.ConvertToInternalUnits(IN[4],UIunit)

watch = []

def DSCurveToVewSection(c,vft,offset,doc,height,depth):
	locC = c.ToRevitType()
	sp = locC.GetEndPoint(0)
	ep = locC.GetEndPoint(1)
	v = ep-sp
	w = v.GetLength()
	h = 10
	#ViewSectionBoundingBox
	vsBBmin = XYZ(-w/2,0,-offset)
	vsBBmax = XYZ(w/2,height,depth)
	midpoint = sp + 0.5*v
	lineDir = v.Normalize()
	up = XYZ.BasisZ
	viewdir = lineDir.CrossProduct(up).Normalize()
	
	t = Transform.Identity
	t.Origin = midpoint
	t.BasisX = lineDir
	t.BasisY = up
	t.BasisZ = viewdir
	
	vsBB = BoundingBoxXYZ()
	vsBB.Enabled = True
	vsBB.Transform = t
	vsBB.Min = vsBBmin
	vsBB.Max = vsBBmax
	vsBB.set_MinEnabled(0, True)
	vsBB.set_MinEnabled(1, True)
	vsBB.set_MinEnabled(2, True)
	vsBB.set_MaxEnabled(0, True)
	vsBB.set_MaxEnabled(1, True)
	vsBB.set_MaxEnabled(2, True)
	section = ViewSection.CreateSection(doc,ElementId(vft.Id),vsBB)	
	return section
	
TransactionManager.Instance.EnsureInTransaction(doc)
for cvs in curves:
	watch.append(DSCurveToVewSection(cvs,ViewFamilyType,offsetFromWall,doc,height,depth_))
TransactionManager.Instance.TransactionTaskDone

OUT = watch
# ----------------------------------------
ViewSection_s = Output(python_script)  # "ViewSection(s)"
