# Dynamo custom node ViewTemplate.IsApplied.dyf (Dynamo 2.3.0.5885)
# category: Data-Shapes.Revit.Elements
# Returns a boolean value indicating wether a ViewTemplate is applied to any view in the project or not. This won't work for 3D templates.

ViewTemplate = Input(ViewTemplate_: var[]..[])
isApplied = Python(IN[0]=ViewTemplate)  # "ViewTemplate.IsApplied"
# ---------- isApplied.python (41 lines) ----------
#Copyright (c) Data Shapes - Mostafa El Ayoubi ,  2018
# @data_shapes ,  www.data-shapes.io , contact@data-shapes.io

import clr
clr.AddReference('RevitAPI')
from Autodesk.Revit.DB import *
clr.AddReference('RevitServices')
from RevitServices.Persistence import DocumentManager
doc = DocumentManager.Instance.CurrentDBDocument

allViews = [v for v in FilteredElementCollector(doc).OfClass(View).ToElements() if v.IsValidObject]

def toList(input):
	if isinstance(input,list):
		return UnwrapElement(input)
	else:
		return [UnwrapElement(input)]

ViewTemplates = toList(IN[0])

appliedTemplates = []

for view in allViews:
	try:
		viewTemplate = view.ViewTemplateId
		if  viewTemplate not in appliedTemplates:
			appliedTemplates.append(viewTemplate)
		else:
			continue
	except:
		pass
		
isApplied = [] 

for vt in ViewTemplates:
	try:
		isApplied.append(vt.Id in appliedTemplates)
	except:
		pass
		
OUT = isApplied
# ----------------------------------------
bool = Output(isApplied)
