# Dynamo custom node ViewportLocation++.dyf (Dynamo 2.2.1.5175)
# category: Data-Shapes.Revit.Sheets
# Gets the location point of a viewport or a ScheduleSheetInstance

Viewport_Or_ScheduleSheetIndtance = Input(Viewport_Or_ScheduleSheetIndtance: var[]..[])
python_script = Python(IN[0]=Viewport_Or_ScheduleSheetIndtance)
# ---------- python_script.python (38 lines) ----------
#Copyright (c) mostafa el ayoubi ,  2019 , @data_shapes
#Data-Shapes www.data-shapes.io , mostafa.elayoubi@data-shapes.io
import clr
clr.AddReference('RevitAPI')
from Autodesk.Revit.DB import *
clr.AddReference('ProtoGeometry')
from Autodesk.DesignScript.Geometry import Point as dspt
clr.AddReference('RevitServices')
from RevitServices.Persistence import DocumentManager
doc = DocumentManager.Instance.CurrentDBDocument
output = []

clr.AddReference('RevitNodes')
import Revit
clr.ImportExtensions(Revit.GeometryConversion)

from RevitServices.Transactions import TransactionManager
TransactionManager.Instance.ForceCloseTransaction


def toList(input):
	if isinstance(input,list):
		return UnwrapElement(input)
	else:
		return [UnwrapElement(input)]

locs = []

vps = toList(IN[0])

for v in vps:
	try:
		locs.append(v.GetBoxCenter().ToPoint())
	except:
		locs.append(v.Point.ToPoint())
		

OUT = locs
# ----------------------------------------
Point = Output(python_script)
