# Dynamo custom node WallSweepOnWall.dyf (Dynamo 2.10.1.3976)
# category: Data-Shapes.Revit.Walls
# Creates a wallsweep or reveal on a wall

Walls = Input(Walls: var[])
SweepOrRevealType = Input(SweepOrRevealType: var[]..[])
IsReveal = Input(IsReveal: bool = true)
IsVertical = Input(IsVertical: bool = false)
Distance = Input(Distance: var[]..[])
python_script = Python(IN[0]=Walls, IN[1]=SweepOrRevealType, IN[2]=IsReveal, IN[3]=IsVertical, IN[4]=Distance)  # IronPython2
# ---------- python_script.python (57 lines) ----------
#Copyright (c) mostafa el ayoubi, 2016 elayoub.mostafa@gmail.com
#Data-Shapes www.data-shapes.net


import clr
clr.AddReference('RevitAPI')
from Autodesk.Revit.DB import*
clr.AddReference('RevitServices')
from RevitServices.Persistence import DocumentManager
from RevitServices.Transactions import TransactionManager

try:
	from Autodesk.Revit.DB import  UnitType
except:
	from Autodesk.Revit.DB import SpecTypeId


doc = DocumentManager.Instance.CurrentDBDocument

if isinstance(IN[0],list):
	walls = [UnwrapElement(i) for i in IN[0]]
else:
	walls = [UnwrapElement(IN[0])]
	
	
wstype = ElementId(IN[1].Id)
sr = IN[2]
vertical = IN[3]

try:
	UIunit = Document.GetUnits(doc).GetFormatOptions(UnitType.UT_Length).DisplayUnits
except:
	UIunit = Document.GetUnits(doc).GetFormatOptions(SpecTypeId.Length).GetUnitTypeId()



dist = UnitUtils.ConvertToInternalUnits(IN[4],UIunit)

#creating wallsweepinfo
if not sr:
	wsi = WallSweepInfo(WallSweepType.Sweep,vertical)
else:
	wsi = WallSweepInfo(WallSweepType.Reveal,vertical)

#setting distance of sweep
wsi.Distance = dist

#creating wallsweep
TransactionManager.Instance.EnsureInTransaction(doc)
ws = []
for w in walls:
	ws.append(WallSweep.Create(w,wstype,wsi))
TransactionManager.Instance.TransactionTaskDone()



OUT = ws
# ----------------------------------------
WallSweep_s = Output(python_script)  # "WallSweep(s)"
