# Dynamo custom node AllFamilyTypesofCategory.dyf "SvN - AllFamilyTypesofCategory" (Dynamo 2.3.2.15696)
# category: SVN Package.List
# Select all families from category (Including unplaced)

element_types = ElementTypes("FamilySymbol")
all_elements_of_type = ElementsOfType(element_type=element_types)
category = Input(category: var[]..[])
string_from_object = FromObject(obj=category)
getCategory = Element.GetCategory(element=all_elements_of_type)
string_from_object_2 = FromObject(obj=getCategory)
eq = string_from_object == string_from_object_2
filterByBoolMask = List.FilterByBoolMask(list=all_elements_of_type, mask=eq)
all_elements_of_category = Output(filterByBoolMask.in)
rest_of_items = Output(filterByBoolMask.out)
