# Dynamo custom node PopupDialog.dyf "SvN - PopupDialog" (Dynamo 2.3.2.15696)
# category: SVN Package
# Dialog box for information

list = Input(list: var[]..[])
isEmpty = List.IsEmpty(list=list)
content = Input(content: var[]..[])
python_script = Python(IN[0]=isEmpty, IN[1]=content)
# ---------- python_script.python (12 lines) ----------
import clr
clr.AddReference('RevitAPIUI')
from Autodesk.Revit.UI import TaskDialog, TaskDialogCommonButtons, TaskDialogResult, TaskDialogCommandLinkId

bool=IN[0]
content=IN[1]

if bool == True:
	TaskDialog.Show("Warning",content)
	OUT = False
else:
	OUT = True
# ----------------------------------------
bool = Output(python_script)
