# Dynamo custom node Popups.dyf "SvN - Popup w/ Buttons" (Dynamo 2.3.2.15696)
# category: SVN Package
# Pop - up Dialog for boolean

content = Input(content: var[]..[])
python_script = Python(IN[0]=content)
# ---------- python_script.python (27 lines) ----------
import clr

clr.AddReference("RevitAPIUI")
from  Autodesk.Revit.UI import *

contents=IN[0]

buttons = TaskDialogCommonButtons.Yes | TaskDialogCommonButtons.No
returnValue=[]
#assigning this to a dialog result variable allows us to check what the user selected

if isinstance(contents,list):
	dialogResult = TaskDialog.Show("warning:",str(contents),buttons)
	for content in contents:
	#if the user clicks yes, return true to continue
		if dialogResult == TaskDialogResult.Yes:
			returnValue.append(True)
		else:
			returnValue.append(False)
else:
	dialogResult = TaskDialog.Show("warning:",contents,buttons)
	if dialogResult == TaskDialogResult.Yes:
		returnValue.append(True)
	else:
		returnValue.append(False)

OUT = returnValue
# ----------------------------------------
bool = Output(python_script)
