# Dynamo custom node Popups_bool.dyf "SvN - Boooled Popup w/ Buttons" (Dynamo 2.3.2.15696)
# category: SVN Package
# popups for boolean input and confirmed with boolean

content = Input(content: var[]..[])
bools = Input(bools: var[]..[])
python_script = Python(IN[0]=content, IN[1]=bools)
# ---------- python_script.python (28 lines) ----------
import clr

clr.AddReference("RevitAPIUI")
from  Autodesk.Revit.UI import *

contents=IN[0]

buttons = TaskDialogCommonButtons.Yes | TaskDialogCommonButtons.No
returnValue=[]
bool=IN[1]
#assigning this to a dialog result variable allows us to check what the user selected
if bool:
	if isinstance(contents,list):
		dialogResult = TaskDialog.Show("warning:",str(contents),buttons)
		for content in contents:
		#if the user clicks yes, return true to continue
			if dialogResult == TaskDialogResult.Yes:
				returnValue.append(True)
			else:
				returnValue.append(False)
	else:
		dialogResult = TaskDialog.Show("warning:",contents,buttons)
		if dialogResult == TaskDialogResult.Yes:
			returnValue.append(True)
		else:
			returnValue.append(False)

OUT = returnValue
# ----------------------------------------
bool = Output(python_script)
