# Dynamo custom node ReplaceFamilyTypeName.dyf "SvN - ReplaceFamilyTypeName" (Dynamo 2.12.1.8246)
# category: SVN Package.List
# Find String and replace with String

elementType = Input(elementType: var)
name = FamilyType.Name(familyType=elementType)
searchFor = Input(searchFor: string)
contains = String.Contains(string=name, searchFor=searchFor)
filterByBoolMask = List.FilterByBoolMask(list=elementType, mask=contains)
name_2 = Element.Name(element=filterByBoolMask.in)
replaceWith = Input(replaceWith: string)
replace = String.Replace(string=name_2, searchFor=searchFor, replaceWith=replaceWith)
python_script = Python(IN[0]=filterByBoolMask.in, IN[1]=replace)  # IronPython2
# ---------- python_script.python (57 lines) ----------
import clr
clr.AddReference('RevitAPI')
from Autodesk.Revit.DB import *

clr.AddReference("RevitNodes")
import Revit
clr.ImportExtensions(Revit.Elements)

clr.AddReference("RevitServices")
import RevitServices
from RevitServices.Persistence import DocumentManager
from RevitServices.Transactions import TransactionManager

doc = DocumentManager.Instance.CurrentDBDocument
items = UnwrapElement(IN[0])
names = IN[1]

def SetElementName(item, name):
	# family parameters
	if item.GetType().ToString() == "Autodesk.Revit.DB.FamilyParameter":
		try: 
			doc.FamilyManager.RenameParameter(item, name)
			return True
		except: return False
	# regular revit worksets
	elif item.GetType().ToString() =="Autodesk.Revit.DB.Workset":
		try: 
			doc.GetWorksetTable().RenameWorkset(doc, item.Id, name)
			return True
		except: return False
	# archilab worksets (dynamo 1.x)
	elif item.GetType().ToString() == "Archilab.Grimshaw.Elements.Workset":
		try: 
			doc.GetWorksetTable().RenameWorkset(doc, WorksetId(item.Id), name)
			return True
		except: return False
	# archilab worksets (dynamo 2.x)
	elif item.GetType().ToString() == "archilab.Revit.Elements.Workset":
		try: 
			doc.GetWorksetTable().RenameWorkset(doc, WorksetId(item.Id), name)
			return True
		except: return False
	# everything else that has a name property
	else:
		try: 
			item.Name = name
			return True
		except: return False

TransactionManager.Instance.EnsureInTransaction(doc)
if isinstance(IN[0], list):
	if isinstance(names, list): OUT = [SetElementName(x, y) for x, y in zip(items, names)]
	else: OUT = [SetElementName(x, names) for x in items]
else:
	if isinstance(names, list): OUT = SetElementName(items, names[0])
	else: OUT = SetElementName(items, names)
TransactionManager.Instance.TransactionTaskDone()
# ----------------------------------------
Output = Output(python_script)  # ""
