# Dynamo custom node SetGroupNames.dyf "SvN - SetGroupNames"
# category: SVN Package.List
# set group names from giving strings

groupList = Input(groupList: var[]..[])
setName = Input(setName: var[]..[])
python = Python(IN[0]=groupList, IN[1]=setName)  # IronPython2
# ---------- python.python (32 lines) ----------
# Load the Python Standard and DesignScript Libraries
import sys
import clr
clr.AddReference('ProtoGeometry')
from Autodesk.DesignScript.Geometry import *
clr.AddReference('RevitAPI')
from Autodesk.Revit.DB import *
clr.AddReference('RevitServices')
from RevitServices.Persistence import DocumentManager

# The inputs to this node will be stored as a list in the IN variables.
dataEnteringNode = IN

# Define the input variables
elements = UnwrapElement(IN[0])  # Assuming IN[0] contains a list of elements
names = IN[1]

# Create an empty list to store the modified group names
namelist=[]
# Start a new transaction
doc = DocumentManager.Instance.CurrentDBDocument
transaction = Transaction(doc, "Rename Group Types")
transaction.Start()

    # Modify the group names
for group, name in zip(elements, names):
	group.Name = name
	namelist.append(name)
    # Commit the transaction
transaction.Commit()
OUT= namelist
    # Assign the modified group names to the output
# ----------------------------------------
groupName = Output(python)
