# Dynamo custom node String_Contains_Multiple.dyf "SvN - String Contains Multiple" (Dynamo 2.6.2.15705)
# category: SVN Package.List
# search for if multiple strings are contained in other list

listStr = Input(listStr: var[]..[])
searchfor = Input(searchfor: var[]..[])
python_script = Python(IN[0]=listStr, IN[1]=searchfor)
# ---------- python_script.python (16 lines) ----------
# Load the Python Standard and DesignScript Libraries
import sys
import clr
clr.AddReference('ProtoGeometry')
from Autodesk.DesignScript.Geometry import *

# The inputs to this node will be stored as a list in the IN variables.

a=IN[0]
b=IN[1]
listResult=[]
# Place your code below this line
for i in a:
    result=any(substring in i for substring in b)
    listResult.append(result)
OUT= listResult
# ----------------------------------------
