# Dynamo custom node SvN_Export2Excel.dyf (Dynamo 2.19.3.6394)
# category: SVN Package

filePath = Input(filePath: string)
sheetName = Input(sheetName: string = "Sheet1")
dataRows = Input(dataRows: var[]..[])
python_script = Python(IN[0]=filePath, IN[1]=sheetName, IN[2]=dataRows)  # CPython3
# ---------- python_script.python (29 lines) ----------
import os
from openpyxl import Workbook

# Inputs from Dynamo
file_path = IN[0]  # Full file path like "C:\\Temp\\TextNotes.xlsx"
sheet_name = IN[1]  # Sheet/tab name
data = IN[2]  # List of lists (rows)

# Ensure the directory exists
folder = os.path.dirname(file_path)
if not os.path.exists(folder):
    os.makedirs(folder)

try:
    # Create a workbook and sheet
    wb = Workbook()
    ws = wb.active
    ws.title = sheet_name

    # Write data to sheet
    for row in data:
        ws.append(row)

    # Save the workbook
    wb.save(file_path)

    OUT = [file_path, "Export successful"]
except Exception as e:
    OUT = [None, "Export failed: " + str(e)]
# ----------------------------------------
code_block = CodeBlock(x=python_script) { x[0]; x[1]; }
report = Output(code_block.out1)
filePath_2 = Output(code_block.out0)  # "filePath"
