# Dynamo custom node SvN_GetSubcategoryProp.dyf (Dynamo 2.19.3.6394)
# category: SVN Package.List
# Get all property from subcategory

subCategory = Input(subCategory: var[]..[])
python_script = Python(IN[0]=subCategory)  # IronPython2
# ---------- python_script.python (45 lines) ----------
import clr
clr.AddReference('RevitAPI')
from Autodesk.Revit.DB import *

clr.AddReference("RevitNodes")
import Revit
clr.ImportExtensions(Revit.Elements)

clr.AddReference('DSCoreNodes')
import DSCore
from DSCore import Color

clr.AddReference("RevitServices")
import RevitServices
from RevitServices.Persistence import DocumentManager
from RevitServices.Transactions import TransactionManager

doc = DocumentManager.Instance.CurrentDBDocument
subcat = UnwrapElement(IN[0])
if not hasattr(subcat, '__iter__'):
    subcat = [subcat]

listGraph,lineProjWeight,lineProjCut,patname,listR,listG,listB,listMaterial,elements = [],[],[],[],[],[],[],[],[]

for i in subcat:
	id = i.GetLinePatternId(GraphicsStyleType.Projection)
	pat = LinePatternElement.GetLinePattern(doc,id)
	projWeight = i.GetLineWeight(GraphicsStyleType.Projection)
	cutWeight = i.GetLineWeight(GraphicsStyleType.Cut)
	listMaterial.append(i.Material)
	listR.append(i.LineColor.Red)
 	listG.append(i.LineColor.Green)
 	listB.append(i.LineColor.Blue)
	lineProjWeight.append(projWeight)
	lineProjCut.append(cutWeight)
	try:
		patname.append(pat.Name)
	except:
		patname.append("Solid")
		
	style = i.GetGraphicsStyle(GraphicsStyleType.Projection).Name
	listGraph.append(style)
 	elements.append(i)

OUT = listGraph,lineProjWeight,lineProjCut,listR,listG,listB,patname,listMaterial,elements
# ----------------------------------------
