# Dynamo custom node FilterElementbyCategory.dyf "WWP - FilterElementbyCategory" (Dynamo 2.3.2.15696)
# category: WWP Package.List
# Filter listed elements by assigned categories
# packages: archi-lab.net 2023.213.1722

list = Input(list: var[]..[])
getCategory = archilab.Revit.Elements.Elements.GetCategory(element=list)
string_from_object = FromObject(obj=getCategory)
category = Input(category: var[]..[])
string_from_object_2 = FromObject(obj=category)
eq = string_from_object == string_from_object_2
filterByBoolMask = List.FilterByBoolMask(list=list, mask=eq)
elements_of_category = Output(filterByBoolMask.in)
other_elements = Output(filterByBoolMask.out)
