# Dynamo custom node FilterNullorEmpty.DYF "WWP - Filter Null/Empty from List"
# category: WWP Package.List
# Filter list with Null or empty

list = Input(list: var[]..[])
codeBlock = CodeBlock { None; }  # unwired: None
eq = list == codeBlock
filterByBoolMask = List.FilterByBoolMask(list=list, mask=eq)
paraName = Input(paraName: var[]..[])
getParameterValueByName = Element.GetParameterValueByName(element=filterByBoolMask.in, parameterName=paraName)
codeBlock_2 = CodeBlock { ""; }
eq_2 = getParameterValueByName == codeBlock_2
filterByBoolMask_2 = List.FilterByBoolMask(list=filterByBoolMask.in, mask=eq_2)
inList = Output(filterByBoolMask_2.in)
create = List.Create(item0=filterByBoolMask_2.out, item1=filterByBoolMask.out)
outList = Output(create)
