# Dynamo custom node FindCategoryinDictionary.dyf "WWP - Find Element from Catagory" (Dynamo 2.6.2.15705)
# category: WWP Package.List
# Find elements from catagory and make dictionary from elements
# packages: Clockwork for Dynamo 2.x 2.3.0

category = Input(category: var[]..[])
all_family_types_of_category = Custom[All Family Types Of Category](category=category)  # package Clockwork for Dynamo 2.x; Gets all family types/symbols of a given category in the model.
family = FamilyType.Family(familyType=all_family_types_of_category)
family_name = Element.Name(element=family)
type_name = Element.Name(element=all_family_types_of_category)
code_block = CodeBlock(familyName=family_name, typeName=type_name) { familyName+":("+typeName+")"; }
Key = Output(code_block)
Value = Output(all_family_types_of_category)
