# Dynamo custom node FindTitleblock.dyf "WWP - Find Titleblock" (Dynamo 2.6.2.15705)
# category: WWP Package.List
# list all titleblocks
# packages: KAP Packages 0.0.1, Clockwork for Dynamo 2.x 2.3.0

categories = Categories("OST_TitleBlocks")
all_family_types_of_category = Custom[All Family Types Of Category](category=categories)  # package Clockwork for Dynamo 2.x; Gets all family types/symbols of a given category in the model.
family = FamilyType.Family(familyType=all_family_types_of_category)
name = Element.Name(element=family)
code_block = CodeBlock { ["titleblock","Titleblock"]; }
string_Contains_Multiple = Custom[String_Contains_Multiple](listStr=name, searchfor=code_block)  # package KAP Packages; search for if multiple strings are contained in other list
filterByBoolMask = List.FilterByBoolMask(list=all_family_types_of_category, mask=string_Contains_Multiple)
family_2 = FamilyType.Family(familyType=filterByBoolMask.in)
family_name = Element.Name(element=family_2)
type_name = Element.Name(element=filterByBoolMask.in)
code_block_2 = CodeBlock(familyName=family_name, typeName=type_name) { familyName+":("+typeName+")"; }
Key = Output(code_block_2)
Value = Output(filterByBoolMask.in)
