# Dynamo custom node List_Contains_multiple.dyf "WWP - List Contains Multiple" (Dynamo 2.6.2.15705)
# category: WWP Package.List
# get result of list containing elements from other list

list = Input(list: var[]..[])
searchfor = Input(searchfor: var[]..[])
python_script = Python(IN[0]=list, IN[1]=searchfor)
# ---------- python_script.python (23 lines) ----------
# Load the Python Standard and DesignScript Libraries
import sys
import clr
clr.AddReference('ProtoGeometry')
from Autodesk.DesignScript.Geometry import *

# The inputs to this node will be stored as a list in the IN variables.
dataEnteringNode = IN

# Place your code below this line
a=IN[0]
b=IN[1]
# Assign your output to the OUT variable.
listResult=[]

for i in a:
    if i in b:
        result=True
    else:
        result=False
    listResult.append(result)
    
OUT = listResult
# ----------------------------------------
