# Dynamo custom node String2List.dyf "WWP - String to List" (Dynamo 2.3.2.15696)
# category: WWP Package.List
# Make string list elements to list of strings

str = Input(str: var[]..[])
python_script = Python(IN[0]=str)
# ---------- python_script.python (15 lines) ----------
# Load the Python Standard and DesignScript Libraries
import sys
import clr
clr.AddReference('ProtoGeometry')
from Autodesk.DesignScript.Geometry import *

# The inputs to this node will be stored as a list in the IN variables.
dataEnteringNode = IN

# Place your code below this line
listST = UnwrapElement(IN[0])
# Assign your output to the OUT variable.
listPRO=listST.strip('[]').split(',')

OUT = listPRO
# ----------------------------------------
list = Output(python_script)
