# Dynamo custom node StringtoBoolean.dyf "WWP - StringtoBoolean" (Dynamo 2.3.2.15696)
# category: WWP Package.List
# Convert Strings to Boolean

str = Input(str: var[]..[])
python_script = Python(IN[0]=str)
# ---------- python_script.python (20 lines) ----------
# Load the Python Standard and DesignScript Libraries
import sys
import clr
clr.AddReference('ProtoGeometry')
from Autodesk.DesignScript.Geometry import *

# The inputs to this node will be stored as a list in the IN variables.
dataEnteringNode = IN
listT=IN[0]
results=[]
# Place your code below this line
for i in listT:
	if i == "False" or i == "No":
		result = False
	if i == "True" or i== "Yes":
		result = True
	results.append(result)
	
# Assign your output to the OUT variable.
OUT = results
# ----------------------------------------
booLean = Output(python_script)
