# Dynamo custom node Cell Style Settings.dyf (Dynamo 2.2.1.5175)
# category: archilab.Revit.Schedule
# This node will generate a Cell Style Settings that can be used to override cell properties.

backgroundColor = Input(_backgroundColor: var = null)
bold = Input(_bold: var = null)
font = Input(_font: var = null)
fontColor = Input(_fontColor: var = null)
fontSize = Input(_fontSize: var = null)
italics = Input(_italics: var = null)
underline = Input(_underline: var = null)
orientation = Input(_orientation: var = null)
horizontalAlign = Input(_horizontalAlign: var = null)
verticalAlign = Input(_verticalAlign: var = null)
headerText = Input(_headerText: var = null)
borderBottom = Input(_borderBottom: var = null)
borderLeft = Input(_borderLeft: var = null)
borderRight = Input(_borderRight: var = null)
borderTop = Input(_borderTop: var = null)
python_script = Python(IN[0]=backgroundColor, IN[1]=bold, IN[2]=font, IN[3]=fontColor, IN[4]=fontSize, IN[5]=italics, IN[6]=underline, IN[7]=orientation, IN[8]=horizontalAlign, IN[9]=verticalAlign, IN[10]=headerText, IN[11]=borderBottom, IN[12]=borderLeft, IN[13]=borderRight, IN[14]=borderTop)
# ---------- python_script.python (128 lines) ----------
#Copyright(c) 2015, Konrad Sobon
# @arch_laboratory, http://archi-lab.net

import clr
clr.AddReference('ProtoGeometry')
from Autodesk.DesignScript.Geometry import *

# Import RevitAPI
clr.AddReference("RevitAPI")
import Autodesk
from Autodesk.Revit.DB import *

#The inputs to this node will be stored as a list in the IN variable.
dataEnteringNode = IN

_backgroundColor = IN[0]
_bold = IN[1]
_font = IN[2]
_fontColor = IN[3]
_fontSize = IN[4]
_italics = IN[5]
_underline = IN[6]
_orientation = IN[7]
_hAlign = IN[8]
_vAlign = IN[9]
_headerText = IN[10]

_borderBottom = IN[11]
_borderLeft = IN[12]
_borderRight = IN[13]
_borderTop = IN[14]


#design script color to RVT color function
def dsColorToRvtColor(dsColor):
	R = dsColor.Red
	G = dsColor.Green
	B = dsColor.Blue
	return Autodesk.Revit.DB.Color(R,G,B)

options = TableCellStyleOverrideOptions()

if _backgroundColor != None:
	options.BackgroundColor = True
if _bold != None:
	options.Bold = True

borderOptions = [_borderBottom, _borderLeft, _borderRight, _borderTop]
if any(item != None for item in borderOptions):
	options.BorderLineStyle = True

if _borderBottom != None:
	options.BorderBottomLineStyle = True
if _borderLeft != None:
	options.BorderLeftLineStyle = True
if _borderRight != None:
	options.BorderRightLineStyle = True
if _borderTop != None:
	options.BorderTopLineStyle = True

if _font != None:
	options.Font = True
if _fontColor != None:
	options.FontColor = True
if _fontSize != None:
	options.FontSize = True
if _italics != None:
	options.Italics = True
if _underline != None:
	options.Underline = True
if _orientation != None:
	options.TextOrientation = True

if _hAlign != None:
	options.HorizontalAlignment = True
if _vAlign != None:
	options.VerticalAlignment = True

tcs = TableCellStyle()
tcs.SetCellStyleOverrideOptions(options)

if _backgroundColor != None:
	tcs.BackgroundColor = dsColorToRvtColor(_backgroundColor)
if _bold != None:
	tcs.IsFontBold = _bold

if _borderBottom != None:
	tcs.BorderBottomLineStyle = UnwrapElement(_borderBottom).GraphicsStyleCategory.Id
if _borderLeft != None:
	tcs.BorderLeftLineStyle = UnwrapElement(_borderLeft).GraphicsStyleCategory.Id
if _borderRight != None:
	tcs.BorderRightLineStyle = UnwrapElement(_borderRight).GraphicsStyleCategory.Id
if _borderTop != None:
	tcs.BorderTopLineStyle = UnwrapElement(_borderTop).GraphicsStyleCategory.Id

if _font != None:
	tcs.FontName = _font
if _fontColor != None:
	tcs.TextColor = dsColorToRvtColor(_fontColor)
if _fontSize != None:
	tcs.TextSize = _fontSize
if _italics != None:
	tcs.IsFontItalic  = _italics
if _underline != None:
	tcs.IsFontUnderline  = _underline
if _orientation != None:
	tcs.TextOrientation = _orientation

if _hAlign != None:
	if _hAlign == "Left":
		has = HorizontalAlignmentStyle.Left
	elif _hAlign == "Center":
		has = HorizontalAlignmentStyle.Center
	elif _hAlign == "Right":
		has = HorizontalAlignmentStyle.Right
	tcs.FontHorizontalAlignment = has
if _vAlign != None:
	if _vAlign == "Top":
		vas = VerticalAlignmentStyle.Top
	elif _vAlign == "Middle":
		vas = VerticalAlignmentStyle.Middle
	elif _vAlign == "Bottom":
		vas = VerticalAlignmentStyle.Bottom
	tcs.FontVerticalAlignment = vas

_headerOut = [tcs, _headerText]
#Assign your output to the OUT variable
OUT = _headerOut
# ----------------------------------------
out = Output(python_script)  # "_out"
