# Dynamo custom node Delete Linked Model Keynote Tags.dyf (Dynamo 2.2.1.5175)
# category: archilab.Revit.Tags
# Deletes all Keynote Tags that are tagging elements in the linked model. if element in the linked model has a keynote assigned thus a keynote tag reads a proper value it will not be deleted.

keynote = Input(_keynote: var[]..[])
empty = List.Empty()
create = List.Create(item0=keynote, item1=empty)
flatten = List.Flatten(list=create)
python_script = Python(IN[0]=flatten)
# ---------- python_script.python (55 lines) ----------
#Copyright(c) 2014, Konrad Sobon
# @arch_laboratory, http://archi-lab.net

import clr
clr.AddReference('ProtoGeometry')
from Autodesk.DesignScript.Geometry import *

# Import ToDSType(bool) extension method
clr.AddReference("RevitNodes")
import Revit
clr.ImportExtensions(Revit.Elements)

# Import DocumentManager and TransactionManager
clr.AddReference("RevitServices")
import RevitServices
from RevitServices.Persistence import DocumentManager
from RevitServices.Transactions import TransactionManager

from System.Collections.Generic import *

# Import RevitAPI
clr.AddReference("RevitAPI")
import Autodesk
from Autodesk.Revit.DB import *

doc = DocumentManager.Instance.CurrentDBDocument
uiapp = DocumentManager.Instance.CurrentUIApplication
app = uiapp.Application

#The inputs to this node will be stored as a list in the IN variable.
dataEnteringNode = IN

#unwrap elements
elements = []
for i in IN[0]:
	elements.append(UnwrapElement(i))
keyValues = []
bip = BuiltInParameter.KEY_VALUE
for i in elements:
	keyValues.append(i.get_Parameter(bip).AsString())
for i, j in zip(elements, keyValues):
	if i.TaggedLocalElementId.IntegerValue == -1 and j == "":
		# "Start" the transaction
		TransactionManager.Instance.EnsureInTransaction(doc)
		#delete keynotes that are tagging elements in a linked file
		doc.Delete(i.Id)
		# "End" the transaction
		TransactionManager.Instance.TransactionTaskDone()
		message = "Successfully deleted ALL keynotes \n that were tagging elements in a \n linked file."
	else:
		message = "There are no keynotes in this project\nthat are tagging elements in a \n linked file."
		continue

#Assign your output to the OUT variable
OUT = '\n'.join('{:^35}'.format(s) for s in message.split('\n'))
# ----------------------------------------
out = Output(python_script)  # "_out"
