# Dynamo custom node Dispatch.dyf (Dynamo 2.2.1.5175)
# category: archilab.Core.Lists
# Works exactly like the Dispatch component in Grasshopper. Input a list and a matching pattern of True/False to split list into two lists one containing all True arguments while other all False arguments.

list = Input(_list: var[]..[])
pattern = Input(_pattern: var[]..[])
python_script = Python(IN[0]=list, IN[1]=pattern)
# ---------- python_script.python (21 lines) ----------
#Copyright(c) 2015, Konrad K Sobon
# @arch_laboratory, http://archi-lab.net

import clr
clr.AddReference('ProtoGeometry')
from Autodesk.DesignScript.Geometry import *
#The inputs to this node will be stored as a list in the IN variable.
dataEnteringNode = IN

lst = IN[0]
pattern = IN[1]
tList, fList = [], []

for i, j in zip(lst, pattern):
	if j == 1:
		tList.append(i)
	else:
		fList.append(i)

#Assign your output to the OUT variable
OUT = tList, fList
# ----------------------------------------
number = DoubleInput(1)  # graph input
getItemAtIndex = List.GetItemAtIndex(list=python_script, index=number)
false = Output(getItemAtIndex)  # "_false"
number_2 = DoubleInput(0)  # graph input
getItemAtIndex_2 = List.GetItemAtIndex(list=python_script, index=number_2)
true = Output(getItemAtIndex_2)  # "_true"
