# Dynamo custom node Door Set Handing.dyf (Dynamo 2.2.1.5175)
# category: archilab.Revit.Doors
# Determines door set handing (whether its a left or right handed door). Input takes doors, and output will split them into two lists (right and left).

door = Input(_door: var[]..[])
empty = List.Empty()
create = List.Create(item0=door, item1=empty)
flatten = List.Flatten(list=create)
phase = Input(_phase: var[]..[])
python_script = Python(IN[0]=flatten, IN[1]=phase)
# ---------- python_script.python (67 lines) ----------
#Copyright(c) 2015, Konrad Sobon
# @arch_laboratory, http://archi-lab.net

import clr
clr.AddReference('ProtoGeometry')
from Autodesk.DesignScript.Geometry import *

# Import ToDSType(bool) extension method
clr.AddReference("RevitNodes")
import Revit
clr.ImportExtensions(Revit.Elements)

# Import DocumentManager and TransactionManager
clr.AddReference("RevitServices")
import RevitServices
from RevitServices.Persistence import DocumentManager
from RevitServices.Transactions import TransactionManager

from System.Collections.Generic import *

# Import RevitAPI
clr.AddReference("RevitAPI")
import Autodesk
from Autodesk.Revit.DB import *

doc = DocumentManager.Instance.CurrentDBDocument
uiapp = DocumentManager.Instance.CurrentUIApplication
app = uiapp.Application

#The inputs to this node will be stored as a list in the IN variable.
dataEnteringNode = IN

#unwrap inputs
elements = []
for i in IN[0]:
	elements.append(UnwrapElement(i))
phase = UnwrapElement(IN[1])

#check if door has a left or right handed swing
right, left, lhr, rhr = [], [], [], []
for i in elements:
	to_room = i.ToRoom[phase]
	if to_room is not None:
		if not i.FacingFlipped:
			if i.HandFlipped:
				right.append(i)
			else:
				left.append(i)
		else:
			if i.HandFlipped:
				left.append(i)
			else:
				right.append(i)
	else:
		if i.FacingFlipped:
			if i.HandFlipped:
				rhr.append(i)
			else:
				lhr.append(i)
		else:
			if i.HandFlipped:
				lhr.append(i)
			else:
				rhr.append(i)

#Assign your output to the OUT variable
OUT = right, left, rhr, lhr
# ----------------------------------------
number = DoubleInput(0)  # graph input
getItemAtIndex = List.GetItemAtIndex(list=python_script, index=number)
rightHanded = Output(getItemAtIndex)  # "_rightHanded"
number_2 = DoubleInput(1)  # graph input
getItemAtIndex_2 = List.GetItemAtIndex(list=python_script, index=number_2)
leftHanded = Output(getItemAtIndex_2)  # "_leftHanded"
number_3 = DoubleInput(2)  # graph input
getItemAtIndex_3 = List.GetItemAtIndex(list=python_script, index=number_3)
rightHandedReversed = Output(getItemAtIndex_3)  # "_rightHandedReversed"
number_4 = DoubleInput(3)  # graph input
getItemAtIndex_4 = List.GetItemAtIndex(list=python_script, index=number_4)
leftHandedReversed = Output(getItemAtIndex_4)  # "_leftHandedReversed"
