# Dynamo custom node Element Ids.dyf (Dynamo 2.2.1.5175)
# category: archilab.Revit.Elements
# This node will query an element id that can be used with Revit nodes. Dynamo Element Id node returns integer value.

empty = List.Empty()
element = Input(_element: var[]..[])
create = List.Create(item0=empty, item1=element)
flatten = List.Flatten(list=create)
python_script = Python(IN[0]=flatten)
# ---------- python_script.python (21 lines) ----------
import clr
clr.AddReference('ProtoGeometry')
from Autodesk.DesignScript.Geometry import *
# Import RevitAPI
clr.AddReference('RevitAPI')
import Autodesk
#The inputs to this node will be stored as a list in the IN variable.
dataEnteringNode = IN

elements = []
for i in IN[0]:
    elements.append(UnwrapElement(i))

elementIds, idString, guid = [], [], []
for i in elements:
    elementIds.append(i.Id)
    idString.append(i.Id.ToString())
    guid.append(i.UniqueId)
    
#Assign your output to the OUT variable
OUT = elementIds, idString, guid
# ----------------------------------------
code_block = CodeBlock(OUT=python_script) { OUT[0]; OUT[1]; OUT[2]; }
revitElementId = Output(code_block.out0)  # "_revitElementId"
idString = Output(code_block.out1)  # "_idString"
guid = Output(code_block.out2)  # "_guid"
id = Element.Id(element=flatten)
integer = Output(id)  # "_integer"
