# Dynamo custom node Elements on Sheet.dyf (Dynamo 2.2.1.5175)
# category: archilab.Revit.Sheets
# This node will return elements on sheet.

sheets = Input(_sheets: var[]..[])
python_script = Python(IN[0]=sheets)
# ---------- python_script.python (54 lines) ----------
#Copyright(c) 2015, Konrad Sobon
# @arch_laboratory, http://archi-lab.net

import clr
clr.AddReference('ProtoGeometry')
from Autodesk.DesignScript.Geometry import *

# Import ToDSType(bool) extension method
clr.AddReference('RevitNodes')
import Revit
clr.ImportExtensions(Revit.Elements)

# Import DocumentManager and TransactionManager
clr.AddReference('RevitServices')
import RevitServices
from RevitServices.Persistence import DocumentManager
from RevitServices.Transactions import TransactionManager

# Import RevitAPI
clr.AddReference('RevitAPI')
import Autodesk
from Autodesk.Revit.DB import *

doc = DocumentManager.Instance.CurrentDBDocument

#The inputs to this node will be stored as a list in the IN variable.
dataEnteringNode = IN

elements = []
for i in IN[0]:
	elements.append(UnwrapElement(i))

TransactionManager.Instance.EnsureInTransaction(doc)

schName, schId, ids = [], [], []
for i in elements:
	trans = SubTransaction(doc)
	trans.Start()
	ids.append(doc.Delete(i.Id))
	trans.RollBack()

TransactionManager.Instance.TransactionTaskDone()



elementsOnSheet = []
elementsOnSheet1 = []
for i in ids:
	for j in i:
		if doc.GetElement(j) != None:
			elementsOnSheet.append(doc.GetElement(j).GetType())
			elementsOnSheet1.append(doc.GetElement(j))

OUT = elementsOnSheet1
# ----------------------------------------
end = Revit.Transaction.Transaction.End(input=python_script)
out = Output(end)  # "_out"
