# Dynamo custom node Fill Pattern.dyf (Dynamo 2.2.1.5175)
# category: archilab.Revit.Select
# Get Fill Pattern by Name

name = Input(_name: var[]..[])
draftingOrModeling = Input(_draftingOrModeling: var[]..[])
python_script = Python(IN[0]=name, IN[1]=draftingOrModeling)
# ---------- python_script.python (48 lines) ----------
#Copyright(c) 2015, Konrad Sobon
# @arch_laboratory, http://archi-lab.net

# Import ToDSType(bool) extension method
import clr
clr.AddReference("RevitNodes")
import Revit
clr.ImportExtensions(Revit.Elements)

# Import DocumentManager and TransactionManager
clr.AddReference("RevitServices")
import RevitServices
from RevitServices.Persistence import DocumentManager
doc = DocumentManager.Instance.CurrentDBDocument

# Import RevitAPI
clr.AddReference("RevitAPI")
import Autodesk
from Autodesk.Revit.DB import *

import sys
pyt_path = r'C:\Program Files (x86)\IronPython 2.7\Lib'
sys.path.append(pyt_path)

#The inputs to this node will be stored as a list in the IN variable.
dataEnteringNode = IN

name = str(IN[0])
drafting = IN[1]

try:
	errorReport = None
	if drafting:
		fillPatTarget = FillPatternTarget.Drafting
	else:
		fillPatTarget = FillPatternTarget.Model
	fillPat = FillPatternElement.GetFillPatternElementByName(doc, fillPatTarget, name)
	fillPat = fillPat.ToDSType(True)
except:
	# if error accurs anywhere in the process catch it
	import traceback
	errorReport = traceback.format_exc()

#Assign your output to the OUT variable
if errorReport == None:
	OUT = fillPat
else:
	OUT = errorReport
# ----------------------------------------
fillPattern = Output(python_script)  # "_fillPattern"
