# Dynamo custom node Filled Region Area.dyf (Dynamo 2.2.1.5175)
# category: archilab.Revit.FilledRegions
# This node will query an area from the filled region

filledRegion = Input(_filledRegion: var[]..[])
python_script = Python(IN[0]=filledRegion)
# ---------- python_script.python (32 lines) ----------
#Copyright(c) 2015, Konrad Sobon
# @arch_laboratory, http://archi-lab.net

import clr
clr.AddReference('ProtoGeometry')
from Autodesk.DesignScript.Geometry import *

# Import DocumentManager and TransactionManager
clr.AddReference("RevitServices")
import RevitServices
from RevitServices.Persistence import DocumentManager
from RevitServices.Transactions import TransactionManager

# Import RevitAPI
clr.AddReference("RevitAPI")
import Autodesk
from Autodesk.Revit.DB import *

doc = DocumentManager.Instance.CurrentDBDocument
uiapp = DocumentManager.Instance.CurrentUIApplication
app = uiapp.Application

from System.Collections.Generic import *

#The inputs to this node will be stored as a list in the IN variable.
dataEnteringNode = IN
filledRegions = UnwrapElement(IN[0])

paramIndex = Autodesk.Revit.DB.BuiltInParameter.HOST_AREA_COMPUTED

#Assign your output to the OUT variable
OUT = [i.get_Parameter(paramIndex).AsDouble() for i in filledRegions]
# ----------------------------------------
area = Output(python_script)  # "_area"
