# Dynamo custom node FilterByKeysAndValues.dyf (Dynamo 2.6.1.8786)
# category: archilab.Core.Lists
# Creates a dictionary from keys and values, then filters that dictionary by specified list of keys.

keys = Input(keys: var[])
values = Input(values: var[]..[])
byKeysValues = DesignScript.Builtin.Dictionary.ByKeysValues(keys=keys, values=values)
searchKeys = Input(searchKeys: var[])
valueAtKey = DesignScript.Builtin.Dictionary.ValueAtKey(dictionary=byKeysValues, key=searchKeys)
result = Output(valueAtKey)
