# Dynamo custom node Get All Detail Groups.dyf (Dynamo 2.2.1.5175)
# category: archilab.Revit.Select
# This node will retrieve all instances of Detail Groups in the model.

python_script = Python()
# ---------- python_script.python (35 lines) ----------
#Copyright(c) 2015, Konrad Sobon
# @arch_laboratory, http://archi-lab.net

import clr
clr.AddReference('ProtoGeometry')
from Autodesk.DesignScript.Geometry import *

# Import DocumentManager and TransactionManager
clr.AddReference("RevitServices")
import RevitServices
from RevitServices.Persistence import DocumentManager
from RevitServices.Transactions import TransactionManager

# Import RevitAPI
clr.AddReference("RevitAPI")
import Autodesk
from Autodesk.Revit.DB import *

doc = DocumentManager.Instance.CurrentDBDocument
uiapp = DocumentManager.Instance.CurrentUIApplication
app = uiapp.Application

from System.Collections.Generic import *

#The inputs to this node will be stored as a list in the IN variable.
dataEnteringNode = IN

collector = FilteredElementCollector(doc)
groups = collector.OfCategory(BuiltInCategory.OST_IOSDetailGroups).WhereElementIsNotElementType().ToElements()

groupNames = []
for i in groups:
	groupNames.append(i.Name)

OUT = groupNames, groups
# ----------------------------------------
code_block = CodeBlock(OUT=python_script) { OUT[0]; OUT[1]; }
groups = Output(code_block.out1)  # "_groups"
groupNames = Output(code_block.out0)  # "_groupNames"
