# Dynamo custom node Get All Revisions.dyf (Dynamo 2.2.1.5175)
# category: archilab.Revit.Revisions
# This node will return all Revisions currently defined in the mode.

runIt = Input(_runIt: bool = false)
python_script = Python(IN[0]=runIt)
# ---------- python_script.python (45 lines) ----------
# Copyright(c) 2015, Konrad K Sobon
# @arch_laboratory, http://archi-lab.net

import clr
# Import Element wrapper extension methods
clr.AddReference("RevitNodes")
import Revit
clr.ImportExtensions(Revit.Elements)

# Import DocumentManager and TransactionManager
clr.AddReference("RevitServices")
import RevitServices
from RevitServices.Persistence import DocumentManager
doc = DocumentManager.Instance.CurrentDBDocument

# Import RevitAPI
clr.AddReference("RevitAPI")
import Autodesk
from Autodesk.Revit.DB import *

import sys
pyt_path = r'C:\Program Files (x86)\IronPython 2.7\Lib'
sys.path.append(pyt_path)

#The inputs to this node will be stored as a list in the IN variable.
dataEnteringNode = IN
RunIt = IN[0]

if RunIt:
	try:
		errorReport = None
		revisions = FilteredElementCollector(doc).OfCategory(BuiltInCategory.OST_Revisions).WhereElementIsNotElementType().ToElements()
	except:
		# if error accurs anywhere in the process catch it
		import traceback
		errorReport = traceback.format_exc()
else:
	errorReport = "RunIt set to False."


#Assign your output to the OUT variable
if errorReport == None:
	OUT = revisions
else:
	OUT = errorReport
# ----------------------------------------
revision = Output(python_script)  # "_revision"
