# Dynamo custom node Get All Viewport Types.dyf (Dynamo 2.2.1.5175)
# category: archilab.Revit.Viewports
# This node will retrieve all Viewport Types currently in the model.

python_script = Python()  # graph input
# ---------- python_script.python (41 lines) ----------
# Copyright(c) 2015, Konrad K Sobon
# @arch_laboratory, http://archi-lab.net

import clr
# Import Element wrapper extension methods
clr.AddReference("RevitNodes")
import Revit
clr.ImportExtensions(Revit.Elements)

# Import DocumentManager and TransactionManager
clr.AddReference("RevitServices")
import RevitServices
from RevitServices.Persistence import DocumentManager
doc = DocumentManager.Instance.CurrentDBDocument

import sys
pyt_path = r'C:\Program Files (x86)\IronPython 2.7\Lib'
sys.path.append(pyt_path)

# Import RevitAPI
clr.AddReference("RevitAPI")
import Autodesk
from Autodesk.Revit.DB import *

#The inputs to this node will be stored as a list in the IN variable.
dataEnteringNode = IN

try:
	errorReport = None
	viewports = FilteredElementCollector(doc).OfCategory(BuiltInCategory.OST_Viewports).WhereElementIsNotElementType().ToElements()
	types = [doc.GetElement(i) for i in viewports[0].GetValidTypes()]
except:
	# if error accurs anywhere in the process catch it
	import traceback
	errorReport = traceback.format_exc()

#Assign your output to the OUT variable
if errorReport == None:
	OUT = types
else:
	OUT = errorReport
# ----------------------------------------
viewportType = Output(python_script)  # "_viewportType"
