# Dynamo custom node Get Design Options.dyf (Dynamo 2.2.1.5175)
# category: archilab.Revit.Select
# Queries all of the design options currently in the project.

python_script = Python()  # unwired: IN[0]
# ---------- python_script.python (39 lines) ----------
#Copyright(c) 2015, Konrad Sobon
# @arch_laboratory, http://archi-lab.net

import clr
clr.AddReference('ProtoGeometry')
from Autodesk.DesignScript.Geometry import *

# Import ToDSType(bool) extension method
clr.AddReference("RevitNodes")
import Revit
clr.ImportExtensions(Revit.Elements)

# Import DocumentManager and TransactionManager
clr.AddReference("RevitServices")
import RevitServices
from RevitServices.Persistence import DocumentManager
from RevitServices.Transactions import TransactionManager

from System.Collections.Generic import *

# Import RevitAPI
clr.AddReference("RevitAPI")
import Autodesk
from Autodesk.Revit.DB import *

doc = DocumentManager.Instance.CurrentDBDocument
uiapp = DocumentManager.Instance.CurrentUIApplication
app = uiapp.Application

#The inputs to this node will be stored as a list in the IN variable.
dataEnteringNode = IN

#get all design options in the model
designOp = FilteredElementCollector(doc).OfClass(DesignOption).ToElements()
designOpNames = []
for i in designOp:
	designOpNames.append(i.Name.ToString())
#Assign your output to the OUT variable
OUT = designOp, designOpNames
# ----------------------------------------
number = DoubleInput(0)  # graph input
getItemAtIndex = List.GetItemAtIndex(list=python_script, index=number)
designOptions = Output(getItemAtIndex)  # "_designOptions"
number_2 = DoubleInput(1)  # graph input
getItemAtIndex_2 = List.GetItemAtIndex(list=python_script, index=number_2)
names = Output(getItemAtIndex_2)  # "_names"
