# Dynamo custom node Get Filled Regions.dyf (Dynamo 2.2.1.5175)
# category: archilab.Revit.Select
# This node will query up all Filled Regions in the project as well as those in the active view only.

python_script = Python()  # graph input
# ---------- python_script.python (35 lines) ----------
#Copyright(c) 2015, Konrad K Sobon
# @arch_laboratory, http://archi-lab.net

import clr
clr.AddReference('ProtoGeometry')
from Autodesk.DesignScript.Geometry import *

# Import RevitAPI
clr.AddReference("RevitAPI")
import Autodesk
from Autodesk.Revit.DB import *
from Autodesk.Revit.DB.Analysis import *

# Import DocumentManager and TransactionManager
clr.AddReference("RevitServices")
import RevitServices
from RevitServices.Persistence import DocumentManager
from RevitServices.Transactions import TransactionManager

doc = DocumentManager.Instance.CurrentDBDocument

# Import ToDSType(bool) extension method
clr.AddReference("RevitNodes")
import Revit
clr.ImportExtensions(Revit.Elements)
clr.ImportExtensions(Revit.GeometryConversion)

#The inputs to this node will be stored as a list in the IN variable.
dataEnteringNode = IN

inView = FilteredElementCollector(doc, doc.ActiveView.Id).OfClass(FilledRegion)
inProject = FilteredElementCollector(doc).OfClass(FilledRegion)

#Assign your output to the OUT variable
OUT = [i.ToDSType(True) for i in inView],[j.ToDSType(True) for j in inProject]
# ----------------------------------------
code_block = CodeBlock(OUT=python_script) { OUT[0]; OUT[1]; }
activeViewFilledRegions = Output(code_block.out0)  # "_activeViewFilledRegions"
allFilledRegions = Output(code_block.out1)  # "_allFilledRegions"
