# Dynamo custom node Legend Settings.dyf (Dynamo 2.2.1.5175)
# category: archilab.Revit.Analysis
# This node sets all settings for the Legend display with Analysis Visualization Framework of Revit.

showLegend = Input(_showLegend: var[]..[])
showUnits = Input(_showUnits: var[]..[])
showName = Input(_showName: var[]..[])
headingTextTypeId = Input(_headingTextTypeId: var[]..[])
bodyTextTypeId = Input(_bodyTextTypeId: var[]..[])
showDataDescription = Input(_showDataDescription: var[]..[])
rounding = Input(_rounding: var[]..[])
graphHeight = Input(_graphHeight: var[]..[])
graphWidth = Input(_graphWidth: var[]..[])
graphSteps = Input(_graphSteps: var[]..[])
python_script = Python(IN[0]=showLegend, IN[1]=showUnits, IN[2]=showName, IN[3]=headingTextTypeId, IN[4]=bodyTextTypeId, IN[5]=showDataDescription, IN[6]=rounding, IN[7]=graphHeight, IN[8]=graphWidth, IN[9]=graphSteps)
# ---------- python_script.python (58 lines) ----------
#Copyright(c) 2015, Konrad K Sobon
# @arch_laboratory, http://archi-lab.net

import clr
clr.AddReference('ProtoGeometry')
from Autodesk.DesignScript.Geometry import *

# Import DocumentManager and TransactionManager
clr.AddReference("RevitServices")
import RevitServices
from RevitServices.Persistence import DocumentManager
from RevitServices.Transactions import TransactionManager

# Import RevitAPI
clr.AddReference("RevitAPI")
import Autodesk
from Autodesk.Revit.DB import *
from Autodesk.Revit.DB.Analysis import *

doc = DocumentManager.Instance.CurrentDBDocument
uiapp = DocumentManager.Instance.CurrentUIApplication
app = uiapp.Application

#The inputs to this node will be stored as a list in the IN variable.
dataEnteringNode = IN

showLegend = IN[0]
showUnits = IN[1]
showName = IN[2]
headingTextTypeId = IN[3]
bodyTextTypeId = IN[4]
dataDescription = IN[5]
rounding = IN[6]
height = IN[7]
width = IN[8]
steps = IN[9]

#define legend settings
legendSettings = AnalysisDisplayLegendSettings()
if showLegend:
	legendSettings.ShowLegend = True
	#heading
	legendSettings.ShowUnits = showUnits
	legendSettings.ShowDataName = showName
	legendSettings.HeadingTextTypeId = headingTextTypeId[0]
	#body
	legendSettings.TextTypeId = bodyTextTypeId[0]
	legendSettings.ShowDataDescription = dataDescription
	legendSettings.Rounding = rounding
	#color range
	legendSettings.ColorRangeHeight = height
	legendSettings.ColorRangeWidth = width
	legendSettings.NumberOfSteps = steps
else:
	legendSettings.ShowLegend = False

#Assign your output to the OUT variable
OUT = legendSettings
# ----------------------------------------
legendSettings = Output(python_script)  # "_legendSettings"
