# Dynamo custom node New Section Box View By Elements.dyf (Dynamo 2.2.1.5175)
# category: archilab.Revit.Views
# This node will create new section box around specified elements and apply it to a new 3D View with a specified name. Section box will be offset from the elements by a supplied offset values.

elements = Input(_elements: var[]..[])
viewName = Input(_viewName: var[]..[])
offset = Input(_offset: var[]..[])
python_script = Python(IN[0]=elements, IN[1]=viewName, IN[2]=offset)
# ---------- python_script.python (82 lines) ----------
#Copyright(c) 2014, Konrad Sobon
# @arch_laboratory, http://archi-lab.net

import clr
clr.AddReference('ProtoGeometry')
from Autodesk.DesignScript.Geometry import *

# Import ToDSType(bool) extension method
clr.AddReference("RevitNodes")
import Revit
clr.ImportExtensions(Revit.Elements)

# Import DocumentManager and TransactionManager
clr.AddReference("RevitServices")
import RevitServices
from RevitServices.Persistence import DocumentManager
from RevitServices.Transactions import TransactionManager

from System.Collections.Generic import *

# Import RevitAPI
clr.AddReference("RevitAPI")
import Autodesk
from Autodesk.Revit.DB import *

doc = DocumentManager.Instance.CurrentDBDocument
uiapp = DocumentManager.Instance.CurrentUIApplication
app = uiapp.Application

#The inputs to this node will be stored as a list in the IN variable.
dataEnteringNode = IN

elements = []
for i in IN[0]:
	elements.append(UnwrapElement(i))
viewName = IN[1]
offset = float(IN[2])

#get ViewFamilyType for a 3D View
collector = FilteredElementCollector(doc)
viewTypeColl = collector.OfClass(ViewFamilyType)
for i in viewTypeColl:
	if i.ViewFamily == ViewFamily.ThreeDimensional:
		viewType = i
	else:
		continue
# "Start" the transaction
TransactionManager.Instance.EnsureInTransaction(doc)

#define bounding box enclosing all elements
bboxMin, bboxMax = [], []
for i in elements:
	bboxMin.append(i.get_BoundingBox(doc.ActiveView).Min)
	bboxMax.append(i.get_BoundingBox(doc.ActiveView).Max)
minX, minY, minZ, maxX, maxY, maxZ = [], [], [], [], [], []
for i, j in zip(bboxMin, bboxMax):
	minX.append(i.X)
	minY.append(i.Y)
	minZ.append(i.Z)
	maxX.append(j.X)
	maxY.append(j.Y)
	maxZ.append(j.Z)
bboxMinX = min(minX)
bboxMinY = min(minY)
bboxMinZ = min(minZ)
bboxMaxX = max(maxX)
bboxMaxY = max(maxY)
bboxMaxZ = max(maxZ)
#create a bounding box
bbox = BoundingBoxXYZ()
bbox.Min = XYZ((bboxMinX - offset), (bboxMinY - offset), (bboxMinZ - offset))
bbox.Max = XYZ((bboxMaxX + offset), (bboxMaxY + offset), (bboxMaxZ + offset))
#create 3d View
view = View3D.CreateIsometric(doc, viewType.Id)
view.Name = viewName
view.SectionBox = bbox

# "End" the transaction
TransactionManager.Instance.TransactionTaskDone()

#Assign your output to the OUT variable
OUT = 0
# ----------------------------------------
out = Output(python_script)  # "_out"
