# Dynamo custom node Override Fill Pattern in View.dyf (Dynamo 2.2.1.5175)
# category: archilab.Revit.FamilyInstances
# Overrides fill pattern of any element in an active view to specified fill pattern and color

element = Input(_element: var[]..[])
color = Input(_color: var[]..[])
fillPattern = Input(_fillPattern: var[]..[])
python_script = Python(IN[0]=element, IN[1]=color, IN[2]=fillPattern)
# ---------- python_script.python (77 lines) ----------
import clr
clr.AddReference('ProtoGeometry')
from Autodesk.DesignScript.Geometry import *

# Import ToDSType(bool) extension method
clr.AddReference("RevitNodes")
import Revit
clr.ImportExtensions(Revit.Elements)

# Import DocumentManager and TransactionManager
clr.AddReference("RevitServices")
import RevitServices
from RevitServices.Persistence import DocumentManager
from RevitServices.Transactions import TransactionManager

from System.Collections.Generic import *

# Import RevitAPI
clr.AddReference("RevitAPI")
import Autodesk
from Autodesk.Revit.DB import *

doc = DocumentManager.Instance.CurrentDBDocument
uiapp = DocumentManager.Instance.CurrentUIApplication
app = uiapp.Application

import sys
pyt_path = r'C:\Program Files (x86)\IronPython 2.7\Lib'
sys.path.append(pyt_path)

#The inputs to this node will be stored as a list in the IN variable.
dataEnteringNode = IN

def ProcessList(_func, _list):
    return map( lambda x: ProcessList(_func, x) if type(x)==list else _func(x), _list )

def Unwrap(e):
	return UnwrapElement(e)

def ConvertColor(e):
	return Autodesk.Revit.DB.Color(e.Red, e.Green, e.Blue)

def OverrideColorPattern(e, c, f):
	gSettings = OverrideGraphicSettings()
	gSettings.SetProjectionFillColor(c)
	gSettings.SetProjectionFillPatternId(f.Id)
	gSettings.SetCutFillColor(c)
	gSettings.SetCutFillPatternId(f.Id)
	doc.ActiveView.SetElementOverrides(e.Id, gSettings)
	return e
	
elements = ProcessList(Unwrap, IN[0])

colors = ConvertColor(IN[1])

fillPat = UnwrapElement(IN[2])

try:
	errorReport = None
	TransactionManager.Instance.EnsureInTransaction(doc)
	
	test = []
	for i in elements:
		test.append(OverrideColorPattern(i, colors, fillPat))
		
	TransactionManager.Instance.TransactionTaskDone()
except:
	# if error accurs anywhere in the process catch it
	import traceback
	errorReport = traceback.format_exc()


#Assign your output to the OUT variable
if errorReport == None:
	OUT = test
else:
	OUT = errorReport
# ----------------------------------------
element_2 = Output(python_script)  # "_element"
