# Dynamo custom node PassThrough.dyf (Dynamo 2.6.1.8786)
# category: archilab.Core.Lists
# Ripped this off from Clockwork. Sorry Andy.

passThrough = Input(passThrough: var[]..[])
waitFor = Input(waitFor: var[]..[])
code_block = CodeBlock(passthrough=passThrough, waitfor=waitFor) { [passthrough,waitfor][0]; }
passThrough_2 = Output(code_block)  # "passThrough"
