# Dynamo custom node Remap UV Domain.dyf (Dynamo 2.2.1.5175)
# category: archilab.Core.Geometry
# This node takes an input of a reference face and a list of UVs that get remapped into that face's UV Domain. The output is a list of UV Coordinates in that surface's domain.

revitSurface = Input(_revitSurface: var[]..[])
uvs = Input(_uvs: var[]..[])
code_block = CodeBlock(pt=uvs) { pt.U; pt.V; }
python_script = Python(IN[0]=revitSurface, IN[1]=code_block.out0, IN[2]=code_block.out1)
# ---------- python_script.python (121 lines) ----------
#Copyright(c) 2014, Konrad Sobon
# @arch_laboratory, http://archi-lab.net
#special thanks to David Mans from http://neoarchaic.net/ 
#for help with this node

import clr
clr.AddReference('ProtoGeometry')
from Autodesk.DesignScript.Geometry import *

# Import DocumentManager and TransactionManager
clr.AddReference("RevitServices")
import RevitServices
from RevitServices.Persistence import DocumentManager
from RevitServices.Transactions import TransactionManager

# Import RevitAPI
clr.AddReference("RevitAPI")
import Autodesk
from Autodesk.Revit.DB import *

doc = DocumentManager.Instance.CurrentDBDocument
uiapp = DocumentManager.Instance.CurrentUIApplication
app = uiapp.Application

from System.Collections.Generic import *

# Import ToDSType(bool) extension method
clr.AddReference("RevitNodes")
import Revit
clr.ImportExtensions(Revit.Elements)

#The inputs to this node will be stored as a list in the IN variable.
dataEnteringNode = IN
surface = IN[0]
rhptsU = IN[1]
rhptsV = IN[2]

def getFace(element):
	#create geometry options/compute references
	geoOptions = Options()
	geoOptions.ComputeReferences = True
	#extract geometry
	geoElement = element.get_Geometry(geoOptions)
	geoSet = List[GeometryInstance]()
	elemIter = geoElement.GetEnumerator()
	elemIter.Reset()
	while elemIter.MoveNext():
		curElem = elemIter.Current
		geoSet.Add(curElem)
	#extract faces from solids
	for i in geoSet:
		solids = i.SymbolGeometry
		for i in solids:
			faces = i.Faces
	return faces[0]

def getUVsFromPoints(face, ptsU, ptsV):
	UVs = []
	xval = []
	yval = []
	#get face UV domain min and max
	bbox = face.GetBoundingBox()
	minX = float(bbox.Min.U)
	minY = float(bbox.Min.V)
	maxX = float(bbox.Max.U)
	maxY = float(bbox.Max.V)
	# Check if the inputs are a list and find the total number of instances
	if isinstance(ptsU, float):
		xlen = 1
	else:
		xlen = len(ptsU)
	if isinstance(ptsV, float):
		ylen = 1
	else:
		ylen = len(ptsV)
	# Set the loop limit to the longest list length
	if xlen > ylen:
		cnt = xlen
	else:
		cnt = ylen
	for i in range(0,cnt):
		# If U or V is a single item, pass the item, 
		# If i is greater than than the length of a list, pass the last value in the list
		# Else pass the list item i
		if isinstance(ptsU, float):
			xval.append(minX+(maxX-minX)*ptsU)
		else:
			if i >= len(ptsU):
				xval.append(minX+(maxX-minX)*ptsU[(len(ptsU)-1)])
			else:
				xval.append(minX+(maxX-minX)*ptsU[i])
		if isinstance(ptsV, float):
			yval.append(minY+(maxY-minY)*ptsV)
		else:
			if i >= len(ptsV):
				yval.append(minY+(maxY-minY)*ptsV[(len(ptsV)-1)])
			else:
				yval.append(minY+(maxY-minY)*ptsV[i])			
		UVs.append(Autodesk.Revit.DB.UV(xval[i],yval[i]))
	del xval[:]
	del yval[:]
	return UVs

#unwrap surfaces
elements = []
for i in surface:
	elements.append(UnwrapElement(i))

if not any(isinstance(item, list) for item in rhptsU):
	UVList = []
	element = elements[0]
	face = getFace(element)
	UVList = getUVsFromPoints(face, rhptsU, rhptsV)
else:
	UVList = []
	for i, j, k in zip(elements, rhptsU, rhptsV):
		face = getFace(i)
		UVList.append(getUVsFromPoints(face, j, k))

#Assign your output to the OUT variable
OUT = UVList
# ----------------------------------------
uvs_2 = Output(python_script)  # "_uvs"
