# Dynamo custom node Rename Files.dyf (Dynamo 2.2.1.5175)
# category: archilab.Revit.Printing
# This node will use an "identifier" to pick out files from a supplied directory to rename files to a new name supplied. Please make sure to match list lengths of identifier and new name inputs.

directoryPath = Input(_directoryPath: string = "")
identifiers = Input(_identifiers: string = "")
newNames = Input(_newNames: string = "")
runIt = Input(_runIt: bool = false)
python_script = Python(IN[0]=directoryPath, IN[1]=identifiers, IN[2]=newNames, IN[3]=runIt)
# ---------- python_script.python (40 lines) ----------
# Copyright(c) 2016, Konrad Sobon
# @arch_laboratory, http://archi-lab.net

import sys
pyt_path = r'C:\Program Files (x86)\IronPython 2.7\Lib'
sys.path.append(pyt_path)

import os

filePath = IN[0]
identifiers = IN[1]
newNames = IN[2]
RunIt = IN[3]

files = os.listdir(filePath)

if RunIt:
	try:
		errorReport = None
		for file in files:
			currentFileName = filePath + "\\" + file
		
			for i, j in zip(identifiers, newNames):
				newFileName = filePath + "\\" + j
	
				if i in file and currentFileName != newFileName:
					os.rename(currentFileName, newFileName)
	except:
		# if error accurs anywhere in the process catch it
		import traceback
		errorReport = traceback.format_exc()
else:
	errorReport = "Set RunMe to True."

#Assign your output to the OUT variable
if errorReport == None:
	OUT = sheets
else:
	OUT = errorReport
	
# ----------------------------------------
out = Output(python_script)  # "_out"
