# Dynamo custom node Revision Properties.dyf (Dynamo 2.2.1.5175)
# category: archilab.Revit.Revisions
# This node will return some most common Revision properties like Description or Issue Date.

revision = Input(_revision: var[]..[])
python_script = Python(IN[0]=revision)
# ---------- python_script.python (68 lines) ----------
# Copyright(c) 2015, Konrad K Sobon
# @arch_laboratory, http://archi-lab.net

import clr
# Import Element wrapper extension methods
clr.AddReference("RevitNodes")
import Revit
clr.ImportExtensions(Revit.Elements)

# Import DocumentManager and TransactionManager
clr.AddReference("RevitServices")
import RevitServices
from RevitServices.Persistence import DocumentManager
doc = DocumentManager.Instance.CurrentDBDocument

# Import RevitAPI
clr.AddReference("RevitAPI")
import Autodesk
from Autodesk.Revit.DB import *

import sys
pyt_path = r'C:\Program Files (x86)\IronPython 2.7\Lib'
sys.path.append(pyt_path)

#The inputs to this node will be stored as a list in the IN variable.
dataEnteringNode = IN

def ProcessList(_func, _list):
    return map( lambda x: ProcessList(_func, x) if type(x)==list else _func(x), _list )

def UnwrapNestedList(e):
	return UnwrapElement(e)
def GetSequence(e):
	return e.SequenceNumber
def GetDate(e):
	return e.RevisionDate
def GetIssuedTo(e):
	return e.IssuedTo
def GetIssuedBy(e):
	return e.IssuedBy
def GetIssued(e):
	return e.Issued
def GetDescription(e):
	return e.Description

if isinstance(IN[0], list):
	revs = ProcessList(UnwrapNestedList, IN[0])
else:
	revs = [UnwrapElement(IN[0])]

try:
	errorReport = None
	sequence = ProcessList(GetSequence, revs)
	date = ProcessList(GetDate, revs)
	description = ProcessList(GetDescription, revs)
	issued = ProcessList(GetIssued, revs)
	issuedTo = ProcessList(GetIssuedTo, revs)
	issuedBy = ProcessList(GetIssuedBy, revs)
except:
	# if error accurs anywhere in the process catch it
	import traceback
	errorReport = traceback.format_exc()

#Assign your output to the OUT variable
if errorReport == None:
	OUT = [sequence, date, description, issued, issuedTo, issuedBy]
else:
	OUT = errorReport
# ----------------------------------------
code_block = CodeBlock(IN=python_script) { sequence = IN[0]; date = IN[1]; description = IN[2]; issued = IN[3]; issuedTo = IN[4]; issuedBy = IN[5]; }
sequence = Output(code_block.sequence)  # "_sequence"
date = Output(code_block.date)  # "_date"
description = Output(code_block.description)  # "_description"
issued = Output(code_block.issued)  # "_issued"
issuedTo = Output(code_block.issuedTo)  # "_issuedTo"
issuedBy = Output(code_block.issuedBy)  # "_issuedBy"
