# Dynamo custom node RoomBoundaries.CleanNulls.dyf (Dynamo 2.2.1.5175)
# category: archilab.Revit.Room
# This node will take a set of room boundary curves and elements and remove nulls from element list while joining curves to mainatain matching list structure.

element = Input(_element: var[]..[])
curve = Input(_curve: var[]..[])
python_script = Python(IN[0]=element, IN[1]=curve)
# ---------- python_script.python (25 lines) ----------
import clr
import sys
clr.AddReference('ProtoGeometry')
from Autodesk.DesignScript.Geometry import *

from System import Array
from System.Collections.Generic import *

walls = IN[0]
curves = IN[1]


for i, (wList, cList) in enumerate(zip(walls, curves)):
	for j, (wall, curve) in enumerate(zip(wList, cList)):
		if wall == None:
			del walls[i][j]
			# take corresponding curve and join it to next one in order
			# if there is no next one, then use previous
			curveList = [curves[i][j], curves[i][j+1]]
			curveArray = List[Curve](curveList)
			newPolyCurve = PolyCurve.ByJoinedCurves(curveArray)
			curves[i][j+1] = newPolyCurve
			del curves[i][j]

OUT = [walls, curves]
# ----------------------------------------
code_block = CodeBlock(IN=python_script) { IN[0]; IN[1]; }
element_2 = Output(code_block.out0)  # "_element"
curve_2 = Output(code_block.out1)  # "_curve"
