# Dynamo custom node Set BuiltIn Parameter.dyf (Dynamo 2.2.1.5175)
# category: archilab.Revit.Parameter
# This node will take an input of a built in parameter name and set that parameter to given value for given elements.

parameterName = Input(_parameterName: var[]..[])
elements = Input(_elements: var[]..[])
parameterValues = Input(_parameterValues: var[]..[])
python_script = Python(IN[0]=parameterName, IN[1]=elements, IN[2]=parameterValues)
# ---------- python_script.python (68 lines) ----------
# Copyright(c) 2019, Konrad K Sobon
# @arch_laboratory, http://archi-lab.net

import clr
import sys
pyt_path = r'C:\Program Files (x86)\IronPython 2.7\Lib'
sys.path.append(pyt_path)

clr.AddReference("RevitNodes")
import Revit
clr.ImportExtensions(Revit.Elements)

clr.AddReference("RevitServices")
import RevitServices
from RevitServices.Persistence import DocumentManager
from RevitServices.Transactions import TransactionManager
doc = DocumentManager.Instance.CurrentDBDocument

clr.AddReference("RevitAPI")
import Autodesk
from Autodesk.Revit.DB import *
import System

paramName = IN[0]

if not isinstance(IN[1], list):
	elements = [IN[1]]
else:
	elements = IN[1]

if not isinstance(IN[2], list):
	paramValues = [IN[2]]
else:
	paramValues = IN[2]

def GetBuiltInParam(paramName):
	builtInParams = System.Enum.GetValues(BuiltInParameter)
	test = []
	for i in builtInParams:
		if i.ToString() == paramName:
			test.append(i)
			break
		else:
			continue
	return test[0]

try:
	errorReport = None
	TransactionManager.Instance.EnsureInTransaction(doc)
	
	bipName = GetBuiltInParam(paramName)
	for i, j in zip(elements, paramValues):
		param = UnwrapElement(i).get_Parameter(bipName)
		if param.StorageType == StorageType.ElementId:
			id = ElementId(j)
			param.Set(id)
		else:
			param.Set(j)
	
	TransactionManager.Instance.TransactionTaskDone()
except:
	import traceback
	errorReport = traceback.format_exc()

if errorReport == None:
	OUT = IN[1]
else:
	OUT = errorReport
# ----------------------------------------
out = Output(python_script)  # "_out"
