# Dynamo custom node Set Type Parameter.dyf (Dynamo 2.2.1.5175)
# category: archilab.Revit.Parameter
# This node will set a type parameter for an element.

element = Input(_element: var[]..[])
parameterName = Input(_parameterName: var[]..[])
parameterValue = Input(_parameterValue: var[]..[])
python_script = Python(IN[0]=element, IN[1]=parameterName, IN[2]=parameterValue)
# ---------- python_script.python (82 lines) ----------
#Copyright(c) 2015, Konrad K Sobon
# @arch_laboratory, http://archi-lab.net

import clr
clr.AddReference('ProtoGeometry')
from Autodesk.DesignScript.Geometry import *

# Import Element wrapper extension methods
clr.AddReference("RevitNodes")
import Revit
clr.ImportExtensions(Revit.Elements)

# Import geometry conversion extension methods
clr.ImportExtensions(Revit.GeometryConversion)

# Import DocumentManager and TransactionManager
clr.AddReference("RevitServices")
import RevitServices
from RevitServices.Persistence import DocumentManager
from RevitServices.Transactions import TransactionManager

doc = DocumentManager.Instance.CurrentDBDocument
uiapp = DocumentManager.Instance.CurrentUIApplication
app = uiapp.Application

# Import RevitAPI
clr.AddReference("RevitAPI")
import Autodesk
from Autodesk.Revit.DB import *

import System
from System import Array
from System.Collections.Generic import *

# Import ToDSType(bool) extension method
clr.AddReference("RevitNodes")
import Revit
clr.ImportExtensions(Revit.Elements)

import sys
pyt_path = r'C:\Program Files (x86)\IronPython 2.7\Lib'
sys.path.append(pyt_path)

#The inputs to this node will be stored as a list in the IN variable.
dataEnteringNode = IN

elist = IN[0]
paramNames = IN[1]
paramValues = IN[2]

elements = []
outList = []

for i in range(0,len(elist)):
    elements.append(UnwrapElement(elist[i]))

try:
	errorReport = None
	# "Start" the transaction
	TransactionManager.Instance.EnsureInTransaction(doc)
	
	for i, values in zip(elements, paramValues):
		elemType = doc.GetElement(i.GetTypeId())
		params = elemType.Parameters
		for name,value in zip(paramNames, values):
			for j in params:
				if j.Definition.Name == name:
					j.Set(value)
				else:
					continue
	# "End" the transaction
	TransactionManager.Instance.TransactionTaskDone()
except:
	# if error accurs anywhere in the process catch it
	import traceback
	errorReport = traceback.format_exc()

#Assign your output to the OUT variable
if errorReport == None:
	OUT = 0
else:
	OUT = errorReport
# ----------------------------------------
element_2 = Output(python_script)  # "_element"
