# Dynamo custom node Slice String.dyf (Dynamo 2.2.1.5175)
# category: archilab.Core.Strings
# Slices X number of leading or trailing characters from string (boolean true will slice from left while boolean set to false from right)

empty = List.Empty()
string = Input(_string: var[]..[])
create = List.Create(item0=empty, item1=string)
flatten = List.Flatten(list=create)
numberOfCharacters = Input(_numberOfCharacters: var[]..[])
create_2 = List.Create(item0=empty, item1=numberOfCharacters)
flatten_2 = List.Flatten(list=create_2)
leftOrRight = Input(_leftOrRight: var[]..[])
python_script = Python(IN[0]=flatten, IN[1]=flatten_2, IN[2]=leftOrRight)
# ---------- python_script.python (30 lines) ----------
import clr
clr.AddReference('ProtoGeometry')
from Autodesk.DesignScript.Geometry import *
#The inputs to this node will be stored as a list in the IN variable.
dataEnteringNode = IN

strings = IN[0]
numbers = IN[1]
result = []
if len(numbers) != 1:
	for i, j in zip(strings, numbers):
		x = int(j)
		if IN[2] == 1:
			result.append(i[x:])
		else:
			y = int(len(i) - x)
			result.append(i[:y])
else:
	for i in strings:
		if isinstance(numbers, basestring):
			x = int(numbers[0])
		else:
			x = numbers[0]
		if IN[2] == 1:
			result.append(i[x:])
		else:
			y = int(len(i)-x)
			result.append(i[:y])
#Assign your output to the OUT variable
OUT = result
# ----------------------------------------
string_2 = Output(python_script)  # "_string"
