# Dynamo custom node Split.dyf (Dynamo 2.6.1.8786)
# category: archilab.Core.Lists
# This was stolen from Dimitar's spring nodes package. Sorry Dimitar. I needed just one like it.

list = Input(list: var[]..[])
amount = Input(amount: int)
code_block = CodeBlock(l1=list, amt=amount) { DSCore.List.TakeItems(l1, amt); DSCore.List.DropItems(l1, amt); }
list1 = Output(code_block.out0)
list2 = Output(code_block.out1)
