# Dynamo custom node String From List.dyf (Dynamo 2.2.1.5175)
# category: archilab.Core.Strings
# This node will take an input of a list or nested list and then join each element in a list with a given seperator while adding a suffix.

list = Input(_list: var[]..[])
suffix = Input(_suffix: var[]..[])
seperator = Input(_seperator: var[]..[])
python_script = Python(IN[0]=list, IN[1]=suffix, IN[2]=seperator)
# ---------- python_script.python (17 lines) ----------
#Copyright(c) 2015, Konrad Sobon
# @arch_laboratory, http://archi-lab.net

import clr
clr.AddReference('ProtoGeometry')
from Autodesk.DesignScript.Geometry import *
#The inputs to this node will be stored as a list in the IN variable.
dataEnteringNode = IN
fileExtension = IN[1]
underscore = IN[2]

newString = []
for i in IN[0]:
	newString.append(underscore.join(i) + fileExtension)
	
#Assign your output to the OUT variable
OUT = newString
# ----------------------------------------
string = Output(python_script)  # "_string"
