# Dynamo custom node Tag Host Element.dyf (Dynamo 2.2.1.5175)
# category: archilab.Revit.Tags
# This node will retrieve an element that is hosting a given tag.

tag = Input(_tag: var[]..[])
python_script = Python(IN[0]=tag)
# ---------- python_script.python (49 lines) ----------
# Copyright(c) 2019, Konrad K Sobon
# @arch_laboratory, http://archi-lab.net

import clr
clr.AddReference('RevitNodes')
import Revit
clr.ImportExtensions(Revit.Elements)

clr.AddReference('RevitServices')
import RevitServices
from RevitServices.Persistence import DocumentManager
from RevitServices.Transactions import TransactionManager
doc = DocumentManager.Instance.CurrentDBDocument

clr.AddReference('RevitAPI')
import Autodesk
from Autodesk.Revit.DB import *

import sys
pyt_path = r'C:\Program Files (x86)\IronPython 2.7\Lib'
sys.path.append(pyt_path)

if isinstance(IN[0], list):
	elem = [UnwrapElement(i) for i in IN[0]]
else:
	elem = [UnwrapElement(IN[0])]

def ProcessList(_func, _list):
    return map( lambda x:
    process_list(_func, x) if type(x)==list else _func(x), _list )

def GetHostElement(tag):
	if tag.Category.Name == "Room Tags":
		hostElemId = tag.TaggedLocalRoomId
	else:
		hostElemId = tag.TaggedLocalElementId
	return doc.GetElement(hostElemId)

try:
	errorReport = None
	output = ProcessList(GetHostElement, elem)
except:
	import traceback
	errorReport = traceback.format_exc()

if errorReport == None:
	OUT = output
else:
	OUT = errorReport
# ----------------------------------------
element = Output(python_script)  # "_element"
