# Dynamo custom node Tag Text.dyf (Dynamo 2.2.1.5175)
# category: archilab.Revit.Tags
# This node will retireve a text content of a tag.

tag = Input(_tag: var[]..[])
python_script = Python(IN[0]=tag)
# ---------- python_script.python (58 lines) ----------
#Copyright(c) 2015, Konrad K Sobon
# @arch_laboratory, http://archi-lab.net

import clr
clr.AddReference('ProtoGeometry')
from Autodesk.DesignScript.Geometry import *

# Import Element wrapper extension methods
clr.AddReference('RevitNodes')
import Revit
clr.ImportExtensions(Revit.Elements)

# Import DocumentManager and TransactionManager
clr.AddReference('RevitServices')
import RevitServices
from RevitServices.Persistence import DocumentManager
from RevitServices.Transactions import TransactionManager

doc = DocumentManager.Instance.CurrentDBDocument

# Import RevitAPI
clr.AddReference('RevitAPI')
import Autodesk
from Autodesk.Revit.DB import *

import sys
pyt_path = r'C:\Program Files (x86)\IronPython 2.7\Lib'
sys.path.append(pyt_path)

#The inputs to this node will be stored as a list in the IN variable.
dataEnteringNode = IN

if isinstance(IN[0], list):
	elem = [UnwrapElement(i) for i in IN[0]]
else:
	elem = [UnwrapElement(IN[0])]

def ProcessList(_func, _list):
    return map( lambda x:
    process_list(_func, x) if type(x)==list else _func(x), _list )

def GetTagText(tag):
	tagText = tag.TagText
	return tagText

try:
	errorReport = None
	output = ProcessList(GetTagText, elem)
except:
	# if error accurs anywhere in the process catch it
	import traceback
	errorReport = traceback.format_exc()

#Assign your output to the OUT variable
if errorReport == None:
	OUT = output
else:
	OUT = errorReport
# ----------------------------------------
string = Output(python_script)  # "_string"
