# Dynamo custom node TextNote.ByViewPointAndType.dyf (Dynamo 2.2.1.5175)
# category: archilab.Revit.TextNotes
# This node creates a unwrapped (single line) text note in a given view, at a given location with a given text note type style assigned.

view = Input(_view: var[]..[])
point = Input(_point: var[]..[])
text = Input(_text: var[]..[])
textNoteType = Input(_textNoteType: var[]..[])
runIt = Input(_runIt: bool = false)
python_script = Python(IN[0]=view, IN[1]=point, IN[2]=text, IN[3]=textNoteType, IN[4]=runIt)
# ---------- python_script.python (89 lines) ----------
# Copyright(c) 2016, Konrad K Sobon
# @arch_laboratory, http://archi-lab.net

# Import Element wrapper extension methods
import clr
clr.AddReference('ProtoGeometry')
from Autodesk.DesignScript.Geometry import *

clr.AddReference("RevitNodes")
import Revit
clr.ImportExtensions(Revit.Elements)

# Import geometry conversion extension methods
clr.ImportExtensions(Revit.GeometryConversion)

# Import DocumentManager and TransactionManager
clr.AddReference("RevitServices")
import RevitServices
from RevitServices.Persistence import DocumentManager
from RevitServices.Transactions import TransactionManager
doc = DocumentManager.Instance.CurrentDBDocument

# Import RevitAPI
clr.AddReference("RevitAPI")
import Autodesk
from Autodesk.Revit.DB import *

import sys
pyt_path = r'C:\Program Files (x86)\IronPython 2.7\Lib'
sys.path.append(pyt_path)

#The inputs to this node will be stored as a list in the IN variable.
dataEnteringNode = IN

def Unwrap(item):
	return UnwrapElement(item)

def ProcessList(_func, _list):
    return map( lambda x: ProcessList(_func, x) if type(x)==list else _func(x), _list )

def ProcessParallelLists(_func, *lists):
	return map( lambda *xs: ProcessParallelLists(_func, *xs) if all(type(x) is list for x in xs) else _func(*xs), *lists )

if isinstance(IN[0], list):
	views = ProcessList(Unwrap, IN[0])
else:
	views = [Unwrap(IN[0])]

if isinstance(IN[1], list):
	points = ProcessList(Unwrap, IN[1])
else:
	points = [Unwrap(IN[1])]

if isinstance(IN[2], list):
	texts = IN[2]
else:
	texts = [IN[2]]

ttType = Unwrap(IN[3])
RunIt = IN[4]

def CreateTextNote(v, pt, t, id = ttType.Id):
	return TextNote.Create(doc, v.Id, pt.ToXyz(), t, id)

if RunIt:
	try:
		errorReport = None
		# run checks
		checks = False
		if len(views) == len(points) == len(texts):
			checks = True
		else:
			errorReport = "Make sure that View, Point and Text lists match in length."
		TransactionManager.Instance.EnsureInTransaction(doc)
		if checks:
			output = ProcessParallelLists(CreateTextNote, views, points, texts)
		TransactionManager.Instance.TransactionTaskDone()
	except:
		# if error accurs anywhere in the process catch it
		import traceback
		errorReport = traceback.format_exc()
else:
	errorReport = "Please set RunIt to True."

#Assign your output to the OUT variable
if errorReport == None:
	OUT = output
else:
	OUT = errorReport
# ----------------------------------------
textNote = Output(python_script)  # "_textNote"
